# Grasshopper definition parse_mt_structure_json.gh (Grasshopper 1.0.7)
# plug-ins: Karamba3D, Kangaroo2 Components, Pufferfish

panel = Panel("""0
1
1
2
2
0""")
rhino_doc_dir = RhinoDocDir()  # -> rhino_doc_dir
# ---------- rhino_doc_dir: Python ----------
import scriptcontext as sc
from os import path

rhino_doc_dir = path.abspath(path.dirname(sc.doc.Path))
# ---------- end rhino_doc_dir ----------
panel_2 = Panel("""0
6""")

# ---- group: Bar pairs that are assigned to be in contact (i.e. there will be a coupler between them). These indices refer to the bar indices, and pairs are concatenated into a long list.
# I know there is many indices to be assigned - this pain will motivate
# us to write some scripts to find a good contact assignment.
# That's for next week!
panel_3 = Panel(panel)

# ---- group: grounded nodes (these nodes' positions will not be changed in optimization)
point = Point([Point(7.699029521, 2.653613626, 0.1), Point(5.91234253, 1.989166058, 0), Point(7.022369958, 4.103605584, 0)])

# ---- group: input line graph
curve = Curve([<curve referenced from the Rhino model> x3])

# ----
list_item = ListItem(List=curve, Index=0, Wrap=True)
L = GhPythonScript()  # -> lines, contact_info
# ---------- L: Python ----------
p = [[7.02237, 4.10361, 0.220422],
[7.69903, 2.65361, 0.1],
[7.78626, 2.85361, 0.221824],
[6.11234, 2.18917, -0.2],
[6.10764, 1.89805, -0.197726],
[7.21458, 4.16635, 0.293349],
]
ts = [[0, 1, 0.9, 0.1], 
[1, 2, 0.894346, 0.157499], 
[2, 0, 0.894311, 0.118454], 
]

#############################

import rhinoscriptsyntax as rs
import ghpythonlib.components as gh

lines = []
for id in range(int(len(p) / 2)):
    a = gh.ConstructPoint(*p[id * 2])
    b = gh.ConstructPoint(*p[2 * id + 1])
    print(a)
    print(b)
    lines.append(gh.Line(a, b))

from ghpythonlib.treehelpers import list_to_tree
contact_info = list_to_tree(ts, source=[])
# ---------- end L ----------
end_points = EndPoints(Curve=L.lines)  # -> Start, End

bar_radius_m = Slider(0.01, range=0..0.1)
number = Number(bar_radius_m)
square = Square(Value=number)
pi = Pi(Factor=square)

point_2 = Point(end_points.Start)
file_name_please_end_with_json = Panel("one_tet_0622.json")
list_item_2 = ListItem(List=curve, Index=Slider(8, range=0..9), Wrap=True)

# ---- group: input line graph
curve_2 = Curve(curve)

# ----
ghpython_script = GhPythonScript(lines=curve_2)  # -> out, line_list, pair_list, flat_list, points; inputs lines: list of Curve
# ---------- ghpython_script: Python ----------
import rhinoscriptsyntax as rs
import Rhino.Geometry as rg
from itertools import combinations

points = []
pair_list = []
line_list = []

for index,line in enumerate(lines):
    line_list.append(line)
    length = rg.Curve.GetLength(line)
    end_vertex = rg.Curve.PointAtLength(line,length)
    start_vertex = rg.Curve.PointAtLength(line,0)
    
    if end_vertex in points:
        pass
    else:
        points.append(end_vertex)
        
group = []

for idp, p in enumerate(points):
    for index,line in enumerate(lines):
    # get the line from a point and their index to a list(a,b,c)
        if rg.Curve.ClosestPoint(line,p,0.001)[0]:
            pair_list.append(index)

for i in range(0,len(pair_list)):
    group.append(pair_list[i:i+2])
    #choosetwo_list = list(combinations(group,2))
    #p_list.append(choosetwo_list)
    #print choosetwo_list
#print(group)

group_delete = group[2:len(group):3]

for delete in group_delete:
    group.remove(delete)
#print(group)

flat_list = [ num for sublist in group for num in sublist ]
print(flat_list)
# ---------- end ghpython_script ----------
geometry = Geometry(ghpython_script.points)
point_list = PointList(Points=geometry, Size=Slider(0.2, range=0..1))
geometry_2 = Geometry(ghpython_script.line_list)

# ---- group: bar indices display
list_length = ListLength(List=geometry_2)
curve_middle = CurveMiddle(Curve=geometry_2)
series = Series(Start=0, Step=1, Count=list_length)
text_tag = TextTag(Location=curve_middle, Text=series)

# ---- group: grounded nodes (these nodes' positions will not be changed in optimization)
point_3 = Point([<point referenced from the Rhino model> x4])

# ----
curve_3 = Curve(reparameterize(L.lines))
ghpython_script_2 = GhPythonScript(x=file_name_please_end_with_json)  # -> out, a
# ---------- ghpython_script_2: Python ----------
if x.endswith('_MT.json'):
    a = x[:-8] + '.json'
elif x.endswith('.json'):
    a = x[:-5] + '_MT.json'
else:
    a = x
# ---------- end ghpython_script_2 ----------
line_line_intersection_karamba3d = LineLineIntersectionKaramba3D(Line=curve_2, LimitDistance_m=0.005)  # -> IntersectionPoints, LineSubSegements
list_item_3 = ListItem(List=L.contact_info, Index=0, Wrap=True)  # -> Item, Item1, Item2, Item3
integer = Integer(panel_3)
panel_4 = Panel(ghpython_script_2.a)
end_points_2 = EndPoints(Curve=curve_2)  # -> Start, End
pipe = Pipe(Curve=curve_3, Radius="0.01", Caps=1)  # -> flatten(Pipe)

# ---- group: Configuration for the multi-tangent optimization
# initial_value - dev <= P_xyz <= initial_value + dev
# (1 - ratio) * initial_L <= ||pi0 - pi1|| <= (1 + ratio) * initial_L
smallest_distance_between_two_bars_that = Panel("0.07")  # "Smallest distance between two bars that are not in contact [m], -1 means use summed bar radius"
the_distance_between_two_contact_bars_da = Panel("0.016")  # "the distance between two contact bars (dashed line above), this is related to the coupler's dimension [m]"
optimization_weight_id0_approx_original = Panel("""0.0
10.0""")  # "optimization weight | id0: approx original line graph, id1: contact energy"
physical_length_unit_for_preventing_clam = Panel("0.024")  # "physical length unit for preventing clamp collision [m]"
shape_deviation_m = Slider(0.2, range=0..1)
ghpython_script_3 = GhPythonScript(
    clamp_gap=the_distance_between_two_contact_bars_da,
    clamp_collision_dist=physical_length_unit_for_preventing_clam,
    bar_collision_distance=smallest_distance_between_two_bars_that,
    contact_inds=integer,
    opt_weights=optimization_weight_id0_approx_original,
    shape_deviation=shape_deviation_m,
    length_deviation_ratio=Slider(0.2, range=0..1))  # -> out, mt_config; inputs contact_inds: list of Int32, collision_inds: list of Int32, opt_weights: list
# ---------- ghpython_script_3: Python ----------
import Rhino.Geometry.Point3d as Point3d
import Grasshopper.DataTree as DataTree # Add, AddRange(list, GHPath(i, j))
import Grasshopper.Kernel.Data.GH_Path as GHPath
import System

from ghpythonlib.treehelpers import list_to_tree, tree_to_list
from collections import namedtuple

ConfigData = namedtuple('ConfigData', ['data'])

data = {}
data['max_tangent'] = None
data['clamp_gap'] = clamp_gap
data['clamp_collision_dist'] = clamp_collision_dist
data['bar_collision_distance'] = bar_collision_distance

assert len(contact_inds) % 2 == 0, 'contact_inds must be provided in pairs, thus the total number should be even!'
assert len(collision_inds) % 2 == 0, 'collision_inds must be provided in pairs, thus the total number should be even!'
data['contact_inds'] = contact_inds
data['collision_inds'] = collision_inds

data['opt_weights'] = opt_weights if len(opt_weights) > 2 else opt_weights + [0.0]
data['shape_deviation'] = shape_deviation
data['length_deviation_ratio'] = length_deviation_ratio

mt_config = ConfigData(data)
# ---------- end ghpython_script_3 ----------

# ----
concatenate = Concatenate(FragmentA=rhino_doc_dir, FragmentB="mt_results\", JoinSeparator="\")
removeduplicatepts = RemoveDuplicatePts(Points=end_points_2.Start, Tolerance=0.01)
list_item_4 = ListItem(List=curve_3, Index=list_item_3.Item, Wrap=True)
list_item_5 = ListItem(List=curve_3, Index=list_item_3.Item1, Wrap=True)
removeduplicatepts_2 = RemoveDuplicatePts(Points=line_line_intersection_karamba3d.IntersectionPoints, Tolerance=0.01)
evaluate_curve = EvaluateCurve(Curve=list_item_4, Parameter=list_item_3.Item2)  # -> Point, Tangent, Angle
evaluate_curve_2 = EvaluateCurve(Curve=list_item_5, Parameter=list_item_3.Item3)  # -> Point, Tangent, Angle
concatenate_2 = Concatenate(FragmentA=concatenate, FragmentB=panel_4)

# ---- group: input
curve_4 = Curve(list_item)
curve_5 = Curve(curve_2)
point_4 = Point(point_3)

# ----
point_5 = Point(removeduplicatepts)
point_6 = Point(removeduplicatepts_2)
number_2 = Number(the_distance_between_two_contact_bars_da)
distance = Distance(PointA=evaluate_curve.Point, PointB=evaluate_curve_2.Point)
line = Line(StartPoint=evaluate_curve.Point, EndPoint=evaluate_curve_2.Point)
multiplication = Multiplication(A="0.01", B=2)
concatenate_3 = Concatenate(FragmentA=rhino_doc_dir, FragmentB="frame_assembly\", JoinSeparator="\")
panel_5 = Panel("""0,2,3
0,5,6
1,6,7
1,4,3
5,7,8
2,4,8""")
L_2 = GhPythonScript(file_path=concatenate_2, scale="1")  # -> out, lines, contact_residues, radius, coupler_planes, ti, tj
# ---------- L_2: Python ----------
import json
import ghpythonlib.components as gh
import Rhino.Geometry.Plane as Plane
import Rhino.Geometry.Vector3d as Vector3d
import Rhino.Geometry.Point3d as Point3d

with open(file_path) as json_data:
    data = json.load(json_data)

print('Optimization: {}'.format('Success' if data['nstatus'] == 0 else 'Failed'))
ps = data['line_pt_pairs']
contact_id_pairs = data['contact_id_pairs']
contact_t_pairs = data['contact_t_pairs']
contact_residues = data['contact_residues']
lines = []
for p0,p1 in ps:
    a = gh.ConstructPoint(*p0)
    b = gh.ConstructPoint(*p1)
    a *= scale
    b *= scale
    lines.append(gh.Line(a, b))

radius = data['radius']

Ci = []
Cj = []
ti = []
tj = []
for cid, t in zip(contact_id_pairs, contact_t_pairs):
    Ci.append(lines[cid[0]])
    Cj.append(lines[cid[1]])
    ti.append(t[0])
    tj.append(t[1])

coupler_planes = []
for coupler_data in data['half_couplers']:
    tform = coupler_data['pose']
    plane = Plane(Point3d(*[tform[i][3] for i in range(3)]),
                  Vector3d(*[tform[i][0] for i in range(3)]),
                  Vector3d(*[tform[i][1] for i in range(3)])
                  )
    coupler_planes.append(plane)
# ---------- end L_2 ----------

# ----
# Steps:
# 1. Draw line graph, indice support nodes
# 2. Write contact assignment, and tweak other parameters if needed
# 3. Change file name and click <write frame json file> button
# 4. In docker, run script
# 5. Refresh GH (middle key, ▶ button)
convergence_status = Panel(L_2.out)
write_frame_json_file = Button()

subtraction = Subtraction(A=distance, B=number_2, C=multiplication)

# ---- group: Converting a line graph to a network representation
ghpython_script_4 = GhPythonScript(lines=curve_5, fixed_lines=curve_4)  # -> out, nodes, simplify(edges), fixed_edges; inputs lines: list of Line, fixed_lines: list of Line
# ---------- ghpython_script_4: Python ----------
import Rhino.Geometry.Point3d as Point3d
import Grasshopper.DataTree as DataTree # Add, AddRange(list, GHPath(i, j))
import Grasshopper.Kernel.Data.GH_Path as GHPath
import System

from ghpythonlib.treehelpers import list_to_tree, tree_to_list

import Rhino
import rhinoscriptsyntax as rs
import scriptcontext as sc

def line_to_graph(lines, fixed_lines):
    # This dictionary will map unique points to indices
    point_dict = {}
    
    # These lists will hold the unique points and edges
    pts = []
    edges = []
    fixed_edges = []
    
    for line in lines:
        # Check if the start point is already in the dictionary
        for k, existing_pt in enumerate(pts):
            if existing_pt.DistanceTo(line.From) < 1e-6:
                v0 = k
                break
        else:
            pts.append(line.From)
            v0 = len(pts)-1
        
        for k, existing_pt in enumerate(pts):
            if existing_pt.DistanceTo(line.To) < 1e-6:
                v1 = k
                break
        else:
            pts.append(line.To)
            v1 = len(pts)-1
        
        edge = [v0, v1]
        edges.append(edge)
        
    for i, fl in enumerate(fixed_lines):
        v0, v1 = -1, -1
        for k, existing_pt in enumerate(pts):
            if existing_pt.DistanceTo(fl.From) < 1e-6:
                v0 = k
            if existing_pt.DistanceTo(fl.To) < 1e-6:
                v1 = k
        assert v0 >= 0 and v1 >= 0, "fixed line #{} has end points that do not belong to the line network!".format(i)
        edge = [v0, v1]
        fixed_edges.append(edges.index(edge))
    
    return pts, edges, fixed_edges

nodes, edges, fixed_edges = line_to_graph(lines, fixed_lines)
edges = list_to_tree(edges, [])
# ---------- end ghpython_script_4 ----------

# ----
panel_6 = Panel(ghpython_script_4.nodes)

bounding_box_dimensions = BoundingBoxDimensions(content=curve_5)  # -> result, result_3, result_2
bounding_box_dimension = Panel([bounding_box_dimensions.result, bounding_box_dimensions.result_3, bounding_box_dimensions.result_2])

bar_graph = BarGraph(subtraction, BarColor=RGB(255, 0, 90))
panel_7 = Panel(subtraction)
pipe_2 = Pipe(Curve=L_2.lines, Radius=L_2.radius, Caps=1)  # -> flatten(Pipe)

# ---- group: line indices can be reordered by compas network
list_item_6 = ListItem(List=ghpython_script_4.edges, Index=0, Wrap=True)  # -> Item, Item1
list_item_7 = ListItem(List=ghpython_script_4.nodes, Index=list_item_6.Item1, Wrap=True)
list_item_8 = ListItem(List=ghpython_script_4.nodes, Index=list_item_6.Item, Wrap=True)
line_2 = Line(StartPoint=list_item_8, EndPoint=list_item_7)  # -> flatten(Line)

# ---- group: bar indices display
list_length_2 = ListLength(List=line_2)
curve_middle_2 = CurveMiddle(Curve=line_2)
series_2 = Series(Start=0, Step=1, Count=list_length_2)
text_tag_2 = TextTag(Location=curve_middle_2, Text=series_2)

# ----
point_7 = Point(point_4)
clean_tree = CleanTree(RemoveNulls=True, RemoveInvalid=True, RemoveEmpty=False, Tree=point_7)
list_indices = ListIndices(List=ghpython_script_4.nodes)
point_8 = Point(ghpython_script_4.nodes)
text_tag_3 = TextTag(Location=ghpython_script_4.nodes, Text=list_indices)

# ---- group: Bar length before computation
length = Length(Curve=line_2)
bar_graph_2 = BarGraph(length, BarColor=RGB(255, 0, 90))
mass_addition = MassAddition(Input=length)  # -> Result, PartialResults
panel_8 = Panel(mass_addition.Result)

# ----
unit_x = UnitX(Factor=Slider(5.8, range=0..10))

# ---- group: Bar length after computation
length_2 = Length(Curve=L_2.lines)
bar_graph_3 = BarGraph(length_2, BarColor=RGB(255, 0, 90))
mass_addition_2 = MassAddition(Input=length_2)  # -> Result, PartialResults
panel_9 = Panel(mass_addition_2.Result)

# ----
ghpython_script_5 = GhPythonScript(mt_file_path=concatenate_2)  # -> out, opt_progression_image_path, contact_residue_image_path
# ---------- ghpython_script_5: Python ----------
import os

opt_progression_image_path = mt_file_path[:-8] + '_opt_progression.png'
contact_residue_image_path = mt_file_path[:-8] + '_contact_distance.png'
assert os.path.exists(opt_progression_image_path), opt_progression_image_path
assert os.path.exists(contact_residue_image_path), contact_residue_image_path
# ---------- end ghpython_script_5 ----------
list_item_9 = ListItem(List=point_8, Index=Slider(0, range=0..3), Wrap=True)
rectangle = Rectangle({Plane=PlaneXY(2.775200726, -2.073535271, 0), Size=Domain2(u=-2.726157818..2.726157818, v=-1.943133272..1.943133272)})
move = Move(Geometry=rectangle, Motion=unit_x)  # -> Geometry, Transform
file_path = FilePath(concatenate_3)
point_9 = Point(clean_tree)
ghpython_script_6 = GhPythonScript(
    write=write_frame_json_file,
    indent="1",
    file_path=file_path,
    file_name=file_name_please_end_with_json,
    points=ghpython_script_4.nodes,
    connectivity=ghpython_script_4.edges,
    fixed_line_ids=ghpython_script_4.fixed_edges,
    crossec_area=pi,
    mt_config=ghpython_script_3.mt_config)  # -> out, a; inputs write: Boolean, indent: Int32, points: list of Point3d, connectivity: tree, fixed_line_ids: list of Int32, crossec_area: list
# ---------- ghpython_script_6: Python ----------
import Rhino.Geometry.Point3d as Point3d
import Grasshopper.DataTree as DataTree # Add, AddRange(list, GHPath(i, j))
import Grasshopper.Kernel.Data.GH_Path as GHPath
import System

import os
import json
import math
from collections import defaultdict
from ghpythonlib.treehelpers import list_to_tree, tree_to_list
#########################

if write:
    data = {}
    
    data['nodes'] = []
    for i, pt in enumerate(points):
        pt_data = {
        'is_grounded':False,
        'node_ind' : i,
        'point' : [pt.X, pt.Y, pt.Z]
        }
        data['nodes'].append(pt_data)
        
    
    e_con = tree_to_list(connectivity, lambda x:x)
    data['elements'] = []
    for i, e in enumerate(e_con):
        e_data = {
            'end_node_inds' : e,
            'cross_secs_ind' : i if len(crossec_area) == len(e_con) else 0,
        }
        data['elements'].append(e_data)
    
#    for gpt in grounded_pts:
#        for i, pt in enumerate(points):
#            if gpt.DistanceTo(pt) < 1e-8:
#                data['nodes'][i]['is_grounded'] = True
#                break
    data['fixed_element_ids'] = fixed_line_ids
    
    if len(crossec_area) == 1:
        data['cross_secs'] = [{
            'A' : crossec_area[0],
            'radius' : math.sqrt(crossec_area[0]/math.pi),
        }]
    else:
        assert len(crossec_area) == len(e_con)
        data['cross_secs'] = [{
            'A' : cs,
            'radius' : math.sqrt(cs/math.pi),
        } for cs in crossec_area]

    data["materials"] = [
        {
          "E": 1290000,
          "G12": 460714.2857142857,
          "density": 0.58
        }
    ]
    
    data['mt_config'] = mt_config
    
    with open(os.path.join(file_path, file_name), 'w') as f:
        json.dump(data, f, indent=indent)
# ---------- end ghpython_script_6 ----------
panel_10 = Panel(ghpython_script_4.edges)
import_image = ImportImage(File=ghpython_script_5.opt_progression_image_path, Rectangle=rectangle)
import_image_2 = ImportImage(File=ghpython_script_5.contact_residue_image_path, Rectangle=move.Geometry)

# ---- group: viz for line graph
# grounded nodes
# lines
multiplication_2 = Multiplication(A=bar_radius_m, B=1.5)
curve_6 = Curve(line_2)
point_10 = Point(point_9)
pipe_3 = Pipe(Curve=curve_6, Radius=number, Caps=0)  # -> flatten(Pipe)
sphere = Sphere(Base=point_10, Radius=multiplication_2)
custom_preview = CustomPreview(Geometry=sphere, Material=ColourSwatch(SwatchColor=RGB(0, 0, 0)))
custom_preview_2 = CustomPreview(Geometry=curve_6, Material=ColourSwatch(SwatchColor=RGB(109, 103, 255)))

# ---- group: visualize contact pairs
partition_list = PartitionList(List=panel_3, Size="2")  # -> simplify(Chunks)
list_item_10 = ListItem(List=pipe_3, Index=partition_list, Wrap=True)
tree_statistics = TreeStatistics(Tree=list_item_10)  # -> Paths, Length, Count
list_item_11 = ListItem(List=tree_statistics.Paths, Index=Slider(0, range=0..11), Wrap=True)
tree_branch = TreeBranch(Tree=list_item_10, Path=list_item_11, MaintainPaths=True)
custom_preview_3 = CustomPreview(Geometry=tree_branch, Material=ColourSwatch(SwatchColor=RGB(235, 255, 102)))

# ----
panel_11 = Panel(ghpython_script_6.out)
mesh = Mesh(import_image)
# when the contact residue is smaller than zero, there is collision between bars
mesh_2 = Mesh(import_image_2)

# ---- group: Viz for computed multi-tangent structure
plane = Plane(L_2.coupler_planes)
mesh_3 = Mesh(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)
orient = Orient(Geometry=mesh_3, Source=PlaneXY(0, 0, 0), Target=plane)  # -> Geometry, Transform
preview = CustomPreview(Geometry=pipe_2, Material=ColourSwatch(SwatchColor=RGB(253, 88, 255)))
preview_2 = CustomPreview(Geometry=orient.Geometry, Material=ColourSwatch(SwatchColor=RGB(145, 146, 148)))

# ----
panel_12 = Panel(import_image)

# ==== cluster BoundingBoxDimensions: Bounding Box Dimensions
content = ClusterInput()
bounding_box = BoundingBox(Content=content, Plane=PlaneXY(0, 0, 0), UnionBox=True)  # -> Box, Box_2
deconstruct_box = DeconstructBox(Box=bounding_box.Box)  # -> Plane, X, Y, Z
deconstruct_domain = DeconstructDomain(Domain=deconstruct_box.X)  # -> Start, End
deconstruct_domain_2 = DeconstructDomain(Domain=deconstruct_box.Z)  # -> Start, End
deconstruct_domain_3 = DeconstructDomain(Domain=deconstruct_box.Y)  # -> Start, End
subtraction = Subtraction(A=deconstruct_domain.End, B=deconstruct_domain.Start)
subtraction_2 = Subtraction(A=deconstruct_domain_2.End, B=deconstruct_domain_2.Start)
subtraction_3 = Subtraction(A=deconstruct_domain_3.End, B=deconstruct_domain_3.Start)
result = ClusterOutput(subtraction)
result_2 = ClusterOutput(subtraction_2)
result_3 = ClusterOutput(subtraction_3)
