# Grasshopper definition parse_mt_structure_json_YH(1).gh (Grasshopper 1.0.7)
# plug-ins: Karamba3D, Kangaroo2 Components, NGon, Mesh Pipe

# ---- group: input line graph
# triangle extrude
curve = Curve([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])

# ---- group: grounded nodes (these nodes' positions will not be changed in optimization)
point = Point([Point(7.699029521, 2.653613626, 0.1), Point(5.91234253, 1.989166058, 0), Point(7.022369958, 4.103605584, 0)])

# ---- group: input line graph
curve_2 = Curve([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])

# ---- group: grounded nodes (these nodes' positions will not be changed in optimization)
point_2 = Point([Point(-1.405316049, 5.003042043, 0.1), Point(-1.405316049, 2.234075281, 0.1), Point(-3.827400087, 2.234075281, 0), Point(-3.827400087, 5.003042043, 0), Point(-6.249484124, 5.003042043, 0.1), Point(-6.249484124, 2.234075281, 0.1)])

# ----
# two triangle extrude
# ( file name:
# one_tet_0626_twotri.json )
curve_3 = Curve([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])
# two cube
# ( file name:
# one_tet_0626 )
point_3 = Point([Point(15.61260419, 2.653613626, 0.1), Point(14.93594462, 4.103605584, 0), Point(13.82591719, 1.989166058, 0)])

panel = Panel("1")  # disabled
geometry = Geometry(<brep referenced from the Rhino model>)  # disabled
surface = Surface(<surface referenced from the Rhino model>)  # disabled
panel_2 = Panel("1")  # disabled
mesh_sphere = MeshSphere(Base=PlaneXY(0, 0, 0), Radius=panel_2, UCount=10, VCount=20)  # disabled
triremesh = TriRemesh(Geometry=geometry, Length=panel, Iterations=25)  # -> Triangulation, Dual, Creases; disabled
mesh_edges = MeshEdges(Mesh=triremesh.Triangulation)  # -> NakedEdges, InteriorEdges, NonManifoldEdges; disabled
number_slider = Slider(1.3, range=1..2)  # disabled
number_slider_2 = Slider(0.3, range=0..1)  # disabled
meshprop = MeshProp(Mesh=triremesh.Triangulation, Offset=0, Flip=False)  # -> MeshProperties, FacePlanes, FaceEdgePlanes, EdgePlanes, Mesh; disabled
number_slider_3 = Slider(0, range=0..1)  # disabled
geometry_2 = Geometry(mesh_edges.NakedEdges)  # disabled
geometry_3 = Geometry([mesh_edges.InteriorEdges, mesh_edges.NakedEdges])  # disabled
recipricaledges = RecipricalEdges(Mesh=meshprop.Mesh, Angle=number_slider_2, Scale=number_slider, NormalType=number_slider_3)  # -> Curve, ID0, ID1, Vectors; disabled
end_points = EndPoints(Curve=geometry_2)  # -> Start, End; disabled
geometry_4 = Geometry(end_points.Start)  # disabled
panel_3 = Panel(recipricaledges.Curve)  # disabled
panel_4 = Panel("0.01")  # disabled
geometry_5 = Geometry(recipricaledges.Curve)  # disabled
mesh_pipe = MeshPipe(Curve=geometry_5, Radius=panel_4, Accuracy=0.2, Rotation=0, Segments=10, Caps=2)  # disabled

ghpython_script = GhPythonScript()  # -> out, line_list, pair_list, flat_pair_list, points; inputs lines: list of Curve; disabled
# ---------- ghpython_script: Python ----------
import rhinoscriptsyntax as rs
import Rhino.Geometry as rg
from itertools import combinations

points = []
pair_list = []
line_list = []

for index,line in enumerate(lines):
    line_list.append(line)
    length = rg.Curve.GetLength(line)
    end_vertex = rg.Curve.PointAtLength(line,length)
    start_vertex = rg.Curve.PointAtLength(line,0)
    
    if end_vertex in points:
        pass
    else:
        points.append(end_vertex)
        
#group = []
group_B = []
p_list = []

for idp, p in enumerate(points):
    for index,line in enumerate(lines):
    # get the line from a point and their index to a list(a,b,c)
        if rg.Curve.ClosestPoint(line,p,0.001)[0]:
            pair_list.append(index)

#for i in range(0,len(pair_list)):
#    group.append(pair_list[i:i+2])
#print(group)

for i in range(0,len(pair_list),3):
    group_B.append(pair_list[i:i+3])
for b in group_B:
    choosetwo_list = list(combinations(b,2))
    p_list.append(choosetwo_list)
    #print choosetwo_list
print(p_list)


flat_list = [ num for sublist in p_list for num in sublist ]
group_delete = flat_list[2:len(flat_list):3]
print(group_delete)

#for delete in group_delete:
#    flat_list.remove(delete)
#print(flat_list)

flat_pair_list = [ num for sublist in flat_list for num in sublist ]
# ---------- end ghpython_script ----------
ghpython_script_2 = GhPythonScript()  # -> out, line_list, pair_list, flat_list, points; inputs lines: list of Curve; disabled
# ---------- ghpython_script_2: Python ----------
import rhinoscriptsyntax as rs
import Rhino.Geometry as rg
from itertools import combinations

points = []
pair_list = []
line_list = []

for index,line in enumerate(lines):
    line_list.append(line)
    length = rg.Curve.GetLength(line)
    end_vertex = rg.Curve.PointAtLength(line,length)
    start_vertex = rg.Curve.PointAtLength(line,0)
    
    if end_vertex in points:
        pass
    else:
        points.append(end_vertex)
        
group = []

for idp, p in enumerate(points):
    for index,line in enumerate(lines):
    # get the line from a point and their index to a list(a,b,c)
        if rg.Curve.ClosestPoint(line,p,0.001)[0]:
            pair_list.append(index)

for i in range(0,len(pair_list)):
    group.append(pair_list[i:i+2])
    #choosetwo_list = list(combinations(group,2))
    #p_list.append(choosetwo_list)
    #print choosetwo_list
print(group)

group_delete = group[2:len(group):3]

for delete in group_delete:
    group.remove(delete)
print(group)

flat_list = [ num for sublist in group for num in sublist ]
print(flat_list)
# ---------- end ghpython_script_2 ----------

rhino_doc_dir = RhinoDocDir()  # -> rhino_doc_dir
# ---------- rhino_doc_dir: Python ----------
import scriptcontext as sc
from os import path

rhino_doc_dir = path.abspath(path.dirname(sc.doc.Path))
# ---------- end rhino_doc_dir ----------

bar_radius_m = Slider(0.01, range=0..0.1)
number = Number(bar_radius_m)
square = Square(Value=number)
pi = Pi(Factor=square)

file_name_please_end_with_json = Panel("one_tet_0626_twotri.json")

# ---- group: input line graph
curve_4 = Curve(curve_2)

# ---- group: bar indices display
list_length = ListLength(List=curve_4)
curve_middle = CurveMiddle(Curve=curve_4)
series = Series(Start=0, Step=1, Count=list_length)
text_tag = TextTag(Location=curve_middle, Text=series)

# ---- group: grounded nodes (these nodes' positions will not be changed in optimization)
point_4 = Point(point_2)

# ----
ghpython_script_3 = GhPythonScript(x=file_name_please_end_with_json)  # -> out, a
# ---------- ghpython_script_3: Python ----------
if x.endswith('_MT.json'):
    a = x[:-8] + '.json'
elif x.endswith('.json'):
    a = x[:-5] + '_MT.json'
else:
    a = x
# ---------- end ghpython_script_3 ----------
line_line_intersection_karamba3d = LineLineIntersectionKaramba3D(Line=curve_4, LimitDistance_m=0.005)  # -> IntersectionPoints, LineSubSegements
panel_5 = Panel(ghpython_script_3.a)
concatenate = Concatenate(FragmentA=rhino_doc_dir, FragmentB="mt_results\", JoinSeparator="\")
removeduplicatepts = RemoveDuplicatePts(Points=line_line_intersection_karamba3d.IntersectionPoints, Tolerance=0.01)
concatenate_2 = Concatenate(FragmentA=concatenate, FragmentB=panel_5)

# ---- group: input
curve_5 = Curve(curve_4)
point_5 = Point(point_4)

# ----
point_6 = Point(removeduplicatepts)
ghpython_script_4 = GhPythonScript(lines=curve_4, points=point_6)  # -> out, line_list, pair_list, flat_pair_list, points; inputs lines: list of Curve, points: list of Point3d
# ---------- ghpython_script_4: Python ----------
import rhinoscriptsyntax as rs
import Rhino.Geometry as rg
from itertools import combinations
import random


pair_list = []
line_list = []

#for index,line in enumerate(lines):
#    line_list.append(line)
#    length = rg.Curve.GetLength(line)
#    end_vertex = rg.Curve.PointAtLength(line,length)
#    start_vertex = rg.Curve.PointAtLength(line,0)
#    
#    if end_vertex in points:
#        pass
#    else:
#        points.append(end_vertex)
#        


for idp, p in enumerate(points):
    for index,line in enumerate(lines):
    # get the lines from a point and their index to a list(a,b,c)
        if rg.Curve.ClosestPoint(line,p,0.001)[0]:
            pair_list.append([idp,index])
print (pair_list)

new_pair_list = []
local_lst = []
for pair_id, pair in enumerate(pair_list):
    if pair_id == 0 or pair[0] == pair_list[pair_id-1][0]:
        local_lst.append(pair[1])
    elif pair[0] != pair_list[pair_id-1][0] and pair_id != 0:
        new_pair_list.append(local_lst)
        local_lst = []
        local_lst.append(pair[1])
    if pair_id == len(pair_list)-1:
        new_pair_list.append(local_lst)
print (new_pair_list)


twotwo_list = []
for line in new_pair_list:
    choosetwo_list = list(combinations(line,2))
    twotwo_list.append(choosetwo_list)
print(twotwo_list)

# delete 1 in the twotwo_list if there are 3 lines from 1 points
# Others chooses 2 + (n-3)*2 lines 
for id, pair in enumerate(twotwo_list):
    if len(twotwo_list[id]) == 3:
        print(id)
        
#print(len(twotwo_list[0]))

flat_list = [ num for sublist in twotwo_list for num in sublist ]
group_delete = flat_list[2:len(flat_list):3]
print(group_delete)

for delete in group_delete:
    flat_list.remove(delete)
print(flat_list)

flat_pair_list = [ num for sublist in flat_list for num in sublist ]
# ---------- end ghpython_script_4 ----------
panel_6 = Panel(ghpython_script_4.flat_pair_list)
geometry_6 = Geometry(ghpython_script_4.points)
point_list = PointList(Points=geometry_6, Size=Slider(0.2, range=0..1))

# ---- group: Bar pairs that are assigned to be in contact (i.e. there will be a coupler between them). These indices refer to the bar indices, and pairs are concatenated into a long list.
# I know there is many indices to be assigned - this pain will motivate
# us to write some scripts to find a good contact assignment.
# That's for next week!
panel_7 = Panel(ghpython_script_4.flat_pair_list)

# ----
integer = Integer(panel_7)

# ---- group: Configuration for the multi-tangent optimization
# initial_value - dev <= P_xyz <= initial_value + dev
# (1 - ratio) * initial_L <= ||pi0 - pi1|| <= (1 + ratio) * initial_L
smallest_distance_between_two_bars_that = Panel("0.1")  # "Smallest distance between two bars that are not in contact [m], -1 means use summed bar radius"
the_distance_between_two_contact_bars_da = Panel("0.016")  # "the distance between two contact bars (dashed line above), this is related to the coupler's dimension [m]"
optimization_weight_id0_approx_original = Panel("""1.0
10.0""")  # "optimization weight | id0: approx original line graph, id1: contact energy"
physical_length_unit_for_preventing_clam = Panel("0.024")  # "physical length unit for preventing clamp collision [m]"
shape_deviation_m = Slider(0.3, range=0..1)
ghpython_script_5 = GhPythonScript(
    clamp_gap=the_distance_between_two_contact_bars_da,
    clamp_collision_dist=physical_length_unit_for_preventing_clam,
    bar_collision_distance=smallest_distance_between_two_bars_that,
    contact_inds=integer,
    opt_weights=optimization_weight_id0_approx_original,
    shape_deviation=shape_deviation_m,
    length_deviation_ratio=Slider(0.1, range=0..1))  # -> out, mt_config; inputs contact_inds: list of Int32, collision_inds: list of Int32, opt_weights: list
# ---------- ghpython_script_5: Python ----------
import Rhino.Geometry.Point3d as Point3d
import Grasshopper.DataTree as DataTree # Add, AddRange(list, GHPath(i, j))
import Grasshopper.Kernel.Data.GH_Path as GHPath
import System

from ghpythonlib.treehelpers import list_to_tree, tree_to_list
from collections import namedtuple

ConfigData = namedtuple('ConfigData', ['data'])

data = {}
data['max_tangent'] = None
data['clamp_gap'] = clamp_gap
data['clamp_collision_dist'] = clamp_collision_dist
data['bar_collision_distance'] = bar_collision_distance

assert len(contact_inds) % 2 == 0, 'contact_inds must be provided in pairs, thus the total number should be even!'
assert len(collision_inds) % 2 == 0, 'collision_inds must be provided in pairs, thus the total number should be even!'
data['contact_inds'] = contact_inds
data['collision_inds'] = collision_inds

data['opt_weights'] = opt_weights if len(opt_weights) > 2 else opt_weights + [0.0]
data['shape_deviation'] = shape_deviation
data['length_deviation_ratio'] = length_deviation_ratio

mt_config = ConfigData(data)
# ---------- end ghpython_script_5 ----------

# ----
concatenate_3 = Concatenate(FragmentA=rhino_doc_dir, FragmentB="frame_assembly\", JoinSeparator="\")
panel_8 = Panel("""0,2,3
0,5,6
1,6,7
1,4,3
5,7,8
2,4,8""")
L = GhPythonScript(file_path=concatenate_2, scale="1")  # -> out, lines, contact_residues, radius, coupler_planes, ti, tj
# ---------- L: Python ----------
import json
import ghpythonlib.components as gh
import Rhino.Geometry.Plane as Plane
import Rhino.Geometry.Vector3d as Vector3d
import Rhino.Geometry.Point3d as Point3d

with open(file_path) as json_data:
    data = json.load(json_data)

print('Optimization: {}'.format('Success' if data['nstatus'] == 0 else 'Failed'))
ps = data['line_pt_pairs']
contact_id_pairs = data['contact_id_pairs']
contact_t_pairs = data['contact_t_pairs']
contact_residues = data['contact_residues']
lines = []
for p0,p1 in ps:
    a = gh.ConstructPoint(*p0)
    b = gh.ConstructPoint(*p1)
    a *= scale
    b *= scale
    lines.append(gh.Line(a, b))

radius = data['radius']

Ci = []
Cj = []
ti = []
tj = []
for cid, t in zip(contact_id_pairs, contact_t_pairs):
    Ci.append(lines[cid[0]])
    Cj.append(lines[cid[1]])
    ti.append(t[0])
    tj.append(t[1])

coupler_planes = []
for coupler_data in data['half_couplers']:
    tform = coupler_data['pose']
    plane = Plane(Point3d(*[tform[i][3] for i in range(3)]),
                  Vector3d(*[tform[i][0] for i in range(3)]),
                  Vector3d(*[tform[i][1] for i in range(3)])
                  )
    coupler_planes.append(plane)
# ---------- end L ----------

# ----
# Steps:
# 1. Draw line graph, indice support nodes
# 2. Write contact assignment, and tweak other parameters if needed
# 3. Change file name and click <write frame json file> button
# 4. In docker, run script
# 5. Refresh GH (middle key, ▶ button)
convergence_status = Panel(L.out)
write_frame_json_file = Button()

bounding_box_dimensions = BoundingBoxDimensions(content=curve_5)  # -> result, result_3, result_2
bounding_box_dimension = Panel([bounding_box_dimensions.result, bounding_box_dimensions.result_3, bounding_box_dimensions.result_2])

# ---- group: Converting a line graph to a network representation
ghpython_script_6 = GhPythonScript(lines=curve_5)  # -> out, nodes, simplify(edges); inputs lines: list of Line
# ---------- ghpython_script_6: Python ----------
import Rhino.Geometry.Point3d as Point3d
import Grasshopper.DataTree as DataTree # Add, AddRange(list, GHPath(i, j))
import Grasshopper.Kernel.Data.GH_Path as GHPath
import System

from ghpythonlib.treehelpers import list_to_tree, tree_to_list

import Rhino
import rhinoscriptsyntax as rs
import scriptcontext as sc

def line_to_graph(lines):
    # This dictionary will map unique points to indices
    point_dict = {}
    
    # These lists will hold the unique points and edges
    points = []
    edges = []
    
    # This counter will give each unique point an index
    index_counter = 0
    
    for line in lines:
        # Check if the start point is already in the dictionary
        if line.From not in point_dict:
            # If not, add it to the dictionary and list of points
            point_dict[line.From] = index_counter
            points.append(line.From)
            index_counter += 1
            
        # Do the same for the end point
        if line.To not in point_dict:
            point_dict[line.To] = index_counter
            points.append(line.To)
            index_counter += 1
        
        # Create an edge with the indices of the start and end points
        edge = [point_dict[line.From], point_dict[line.To]]
        edges.append(edge)
    
    return points, edges

nodes, edges = line_to_graph(lines)
edges = list_to_tree(edges, [])
# ---------- end ghpython_script_6 ----------

# ----
pipe = Pipe(Curve=L.lines, Radius=L.radius, Caps=1)  # -> flatten(Pipe)

# ---- group: line indices can be reordered by compas network
list_item = ListItem(List=ghpython_script_6.edges, Index=0, Wrap=True)  # -> Item, Item1
list_item_2 = ListItem(List=ghpython_script_6.nodes, Index=list_item.Item1, Wrap=True)
list_item_3 = ListItem(List=ghpython_script_6.nodes, Index=list_item.Item, Wrap=True)
line = Line(StartPoint=list_item_3, EndPoint=list_item_2)  # -> flatten(Line)

# ---- group: bar indices display
list_length_2 = ListLength(List=line)
curve_middle_2 = CurveMiddle(Curve=line)
series_2 = Series(Start=0, Step=1, Count=list_length_2)
text_tag_2 = TextTag(Location=curve_middle_2, Text=series_2)

# ----
point_7 = Point(point_5)
clean_tree = CleanTree(RemoveNulls=True, RemoveInvalid=True, RemoveEmpty=False, Tree=point_7)
point_8 = Point(ghpython_script_6.nodes)

# ---- group: Bar length before computation
length = Length(Curve=line)
bar_graph = BarGraph(length, BarColor=RGB(255, 0, 90))
mass_addition = MassAddition(Input=length)  # -> Result, PartialResults
panel_9 = Panel(mass_addition.Result)

# ---- group: Bar length after computation
length_2 = Length(Curve=L.lines)
bar_graph_2 = BarGraph(length_2, BarColor=RGB(255, 0, 90))
mass_addition_2 = MassAddition(Input=length_2)  # -> Result, PartialResults
panel_10 = Panel(mass_addition_2.Result)

# ----
file_path = FilePath(concatenate_3)
point_9 = Point(clean_tree)
list_item_4 = ListItem(List=point_8, Index=Slider(3, range=0..3), Wrap=True)
ghpython_script_7 = GhPythonScript(
    write=write_frame_json_file,
    indent="1",
    file_path=file_path,
    file_name=file_name_please_end_with_json,
    points=ghpython_script_6.nodes,
    connectivity=ghpython_script_6.edges,
    grounded_pts=point_9,
    crossec_area=pi,
    mt_config=ghpython_script_5.mt_config)  # -> out, a; inputs write: Boolean, indent: Int32, points: list of Point3d, connectivity: tree, grounded_pts: list of Point3d, crossec_area: list
# ---------- ghpython_script_7: Python ----------
import Rhino.Geometry.Point3d as Point3d
import Grasshopper.DataTree as DataTree # Add, AddRange(list, GHPath(i, j))
import Grasshopper.Kernel.Data.GH_Path as GHPath
import System

import os
import json
import math
from collections import defaultdict
from ghpythonlib.treehelpers import list_to_tree, tree_to_list
#########################

if write:
    data = {}
    
    data['nodes'] = []
    for i, pt in enumerate(points):
        pt_data = {
        'is_grounded':False,
        'node_ind' : i,
        'point' : [pt.X, pt.Y, pt.Z]
        }
        data['nodes'].append(pt_data)
        
    for gpt in grounded_pts:
        for i, pt in enumerate(points):
            if gpt.DistanceTo(pt) < 1e-8:
                data['nodes'][i]['is_grounded'] = True
                break
    
    e_con = tree_to_list(connectivity, lambda x:x)
    data['elements'] = []
    for i, e in enumerate(e_con):
        e_data = {
            'end_node_inds' : e,
            'cross_secs_ind' : i if len(crossec_area) == len(e_con) else 0,
        }
        data['elements'].append(e_data)
    
        
    if len(crossec_area) == 1:
        data['cross_secs'] = [{
            'A' : crossec_area[0],
            'radius' : math.sqrt(crossec_area[0]/math.pi),
        }]
    else:
        assert len(crossec_area) == len(e_con)
        data['cross_secs'] = [{
            'A' : cs,
            'radius' : math.sqrt(cs/math.pi),
        } for cs in crossec_area]

    data["materials"] = [
        {
          "E": 1290000,
          "G12": 460714.2857142857,
          "density": 0.58
        }
    ]
    
    data['mt_config'] = mt_config
    
    with open(os.path.join(file_path, file_name), 'w') as f:
        json.dump(data, f, indent=indent)
# ---------- end ghpython_script_7 ----------
panel_11 = Panel(ghpython_script_6.edges)

# ---- group: viz for line graph
# grounded nodes
# lines
multiplication = Multiplication(A=bar_radius_m, B=1.5)
curve_6 = Curve(line)
point_10 = Point(point_9)
pipe_2 = Pipe(Curve=curve_6, Radius=number, Caps=0)  # -> flatten(Pipe)
sphere = Sphere(Base=point_10, Radius=multiplication)
custom_preview = CustomPreview(Geometry=sphere, Material=ColourSwatch(SwatchColor=RGB(0, 0, 0)))
custom_preview_2 = CustomPreview(Geometry=curve_6, Material=ColourSwatch(SwatchColor=RGB(128, 216, 255)))

# ---- group: visualize contact pairs
partition_list = PartitionList(List=panel_7, Size="2")  # -> simplify(Chunks)
list_item_5 = ListItem(List=pipe_2, Index=partition_list, Wrap=True)
tree_statistics = TreeStatistics(Tree=list_item_5)  # -> Paths, Length, Count
list_item_6 = ListItem(List=tree_statistics.Paths, Index=Slider(19, range=0..50), Wrap=True)
tree_branch = TreeBranch(Tree=list_item_5, Path=list_item_6, MaintainPaths=True)
custom_preview_3 = CustomPreview(Geometry=tree_branch, Material=ColourSwatch(SwatchColor=RGB(235, 255, 102)))

# ----
panel_12 = Panel(ghpython_script_7.out)

# ---- group: Viz for computed multi-tangent structure
plane = Plane(L.coupler_planes)
mesh = Mesh(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)
orient = Orient(Geometry=mesh, Source=PlaneXY(0, 0, 0), Target=plane)  # -> Geometry, Transform
preview = CustomPreview(Geometry=pipe, Material=ColourSwatch(SwatchColor=RGB(253, 88, 255)))
preview_2 = CustomPreview(Geometry=orient.Geometry, Material=ColourSwatch(SwatchColor=RGB(145, 146, 148)))

# ==== cluster BoundingBoxDimensions: Bounding Box Dimensions
content = ClusterInput()
bounding_box = BoundingBox(Content=content, Plane=PlaneXY(0, 0, 0), UnionBox=True)  # -> Box, Box_2
deconstruct_box = DeconstructBox(Box=bounding_box.Box)  # -> Plane, X, Y, Z
deconstruct_domain = DeconstructDomain(Domain=deconstruct_box.X)  # -> Start, End
deconstruct_domain_2 = DeconstructDomain(Domain=deconstruct_box.Z)  # -> Start, End
deconstruct_domain_3 = DeconstructDomain(Domain=deconstruct_box.Y)  # -> Start, End
subtraction = Subtraction(A=deconstruct_domain.End, B=deconstruct_domain.Start)
subtraction_2 = Subtraction(A=deconstruct_domain_2.End, B=deconstruct_domain_2.Start)
subtraction_3 = Subtraction(A=deconstruct_domain_3.End, B=deconstruct_domain_3.Start)
result = ClusterOutput(subtraction)
result_2 = ClusterOutput(subtraction_2)
result_3 = ClusterOutput(subtraction_3)
