# Grasshopper definition parse_mt_structure_json_support_multi_file_YH.gh (Grasshopper 1.0.7)
# plug-ins: Karamba3D, Kangaroo2 Components, Pufferfish, SelectablePreview, Mesh Pipe

number_slider = Slider(14, range=0..30)
mesh = Mesh(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)

curve = Curve([<curve referenced from the Rhino model> x22])  # disabled
curve_2 = Curve(<curve referenced from the Rhino model>)  # disabled

curve_3 = Curve([<curve referenced from the Rhino model> x31])  # disabled
curve_4 = Curve(<curve referenced from the Rhino model>)  # disabled

concatenate = Concatenate(B="{", Fragment_A=number_slider, A=";", Fragment_B=Slider(4, range=0..5), C="}")
curve_5 = Curve([<curve referenced from the Rhino model> x92])  # disabled
mesh_2 = Mesh(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)
curve_middle = CurveMiddle(Curve=curve_5)  # disabled
point_list = PointList(Points=curve_middle)  # disabled

curve_6 = Curve([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])  # disabled
curve_7 = Curve([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])  # disabled

# ----
# domefoot_test
curve_8 = Curve([<curve referenced from the Rhino model> x98])  # disabled
# domefoot_testP
# domefoot_testQ
curve_9 = Curve(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)  # disabled

# ----
# domefoot_testB
curve_10 = Curve(<curve referenced from the Rhino model>)  # disabled
curve_11 = Curve([<curve referenced from the Rhino model> x72])  # disabled

removeduplicatelines = RemoveDuplicateLines(Lines=curve_5, Tolerance=0.01)  # disabled
workpiece = GhPythonScript(mesh=mesh_2)  # -> out, ordered_vertex_neighbors, vertices, edges, contact_ids, contact_ids_tree, lines; inputs mesh: Mesh
# ---------- workpiece: Python ----------
import Rhino.Geometry.Point3d as Point3d
import Grasshopper.DataTree as DataTree # Add, AddRange(list, GHPath(i, j))
import Rhino.Geometry.Line as Line
import Grasshopper.Kernel.Data.GH_Path as GHPath
import System

from itertools import chain
from ghpythonlib.treehelpers import list_to_tree, tree_to_list
from compas_rhino.geometry import RhinoMesh

#Mesh
compas_mesh = RhinoMesh.from_geometry(mesh).to_compas()

edges = [e for e in compas_mesh.edges()]
def find_e_id(e):
    if e in edges:
        return edges.index(e)
    else:
        return edges.index(e[::-1])

vertices = []
ordered_vertex_neighbors = DataTree[int]()
contact_ids = []
contact_ids_tree = DataTree[int]()
for v, v_data in compas_mesh.vertices(data=True):
    vertices.append(Point3d(v_data['x'], v_data['y'], v_data['z']))
    vn = compas_mesh.vertex_neighbors(v, ordered=True)
    ordered_vertex_neighbors.AddRange(vn, GHPath(v))
    
    # ordered ring for reciprocal contact pattern
    for v1, v2 in chain(zip(vn[:-1], vn[1:]), [[vn[-1], vn[0]]]):
        e1, e2 = (v, v1), (v, v2)
        contact_ids.extend([find_e_id(e1), find_e_id(e2)])
        contact_ids_tree.AddRange([find_e_id(e1), find_e_id(e2)], GHPath(v))

lines = [Line(vertices[e[0]], vertices[e[1]]) for e in edges]
# ---------- end workpiece ----------
partition_list = PartitionList(List=workpiece.contact_ids_tree, Size="2")  # -> simplify(Chunks)
curve_12 = Curve(workpiece.lines)
tree_branch = TreeBranch(Tree=partition_list, Path=concatenate, MaintainPaths=True)
move = Move(Geometry=removeduplicatelines, Motion=Vector(0, 0, 10))  # -> Geometry, Transform; disabled
line = Line(move.Geometry)  # disabled

# ----
# alldome
# alldome_4baseline
curve_13 = Curve([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])
curve_14 = Curve([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])

# ----
# foot1
# foot2
# foot3
# foot4
# connectionline
curve_15 = Curve([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])
curve_16 = Curve([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])
curve_17 = Curve([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])
curve_18 = Curve([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])
curve_19 = Curve([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])

curve_20 = Curve(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)  # disabled
curve_21 = Curve([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])  # disabled

curve_22 = Curve(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)  # disabled
curve_23 = Curve([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])  # disabled

curve_24 = Curve([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])  # disabled
curve_25 = Curve(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)  # disabled

curve_26 = Curve(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)  # disabled
curve_27 = Curve([<curve referenced from the Rhino model> x68])  # disabled

curve_28 = Curve([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])  # disabled
curve_29 = Curve(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)  # disabled
construct_path = ConstructPath(Indices=number_slider)

# ---- group: input line graph
curve_30 = Curve(curve_13)

# ----
curve_31 = Curve([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])
curve_32 = Curve(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)

# ---- group: grounded nodes (these nodes' positions will not be changed in optimization)
point = Point([Point(7.699029521, 2.653613626, 0.1), Point(5.91234253, 1.989166058, 0), Point(7.022369958, 4.103605584, 0)])

# ----
tree_branch_2 = TreeBranch(Tree=workpiece.ordered_vertex_neighbors, Path=construct_path, MaintainPaths=True)

# ----
# 5 layer
curve_33 = Curve([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])
curve_34 = Curve([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])

integer = Integer([64, 60, 59, 56, 55, 54, 53, 52, 51, 50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])
integer_2 = Integer([315, 314, 313, 312, 311, 310, 309, 308, 307, 306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])
integer_3 = Integer([218, 217, 216, 215, 214, 213, 212, 211, 210, 209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])
integer_4 = Integer([144, 143, 142, 141, 140, 139, 138, 137, 136, 135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])
integer_5 = Integer([224, 223, 222, 227, 226, 225, 230, 229, 228, 233, 232, 231])

panel = Panel(workpiece.contact_ids_tree)
list_item = ListItem(List=tree_branch_2, Index=Slider(3, range=0..6), Wrap=True)
point_2 = Point(workpiece.vertices)

# ----
# 3 layer
curve_35 = Curve([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])
curve_36 = Curve([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])

integer_6 = Integer([316, 315, 314, 297, 217, 215, 213, 197, 196, 193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])
integer_7 = Integer([301, 300, 299, 221, 220, 219, 218, 216, 212, 211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])
integer_8 = Integer([29, 28, 27, 26, 25, 24, 23, 17, 15, 14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])

# ---- group: full dome
curve_37 = Curve([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])
curve_38 = Curve([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])

# ----
list_item_2 = ListItem(List=curve_12, Index=tree_branch, Wrap=True)
list_item_3 = ListItem(List=point_2, Index=list_item, Wrap=True)
list_item_4 = ListItem(List=point_2, Index=number_slider, Wrap=True)

# ---- group: dodecahedron
curve_39 = Curve([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])
curve_40 = Curve([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])

# ---- group: shape for "technical approach" section
curve_41 = Curve(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)
curve_42 = Curve([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])

# ---- group: hex shell
curve_43 = Curve([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])
curve_44 = Curve([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])

# ----
pipe = Pipe(Curve=list_item_2, Radius=Slider(0.02, range=0..0.1), Caps=0)
custom_preview = CustomPreview(Geometry=pipe, Material=ColourSwatch(SwatchColor=RGB(183, 255, 0)))

# ---- group: half geodesic dome
curve_45 = Curve([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])
curve_46 = Curve([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])

# ----
curve_middle_2 = CurveMiddle(Curve=curve_42)
dot_display = DotDisplay(Point=list_item_4, Colour=RGB(0, 0, 0), Size=Slider(0.056, range=0..1))

# ---- group: three_fork_topopt_vault.json
curve_47 = Curve([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])
curve_48 = Curve([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])

# ----
bounding_box_dimensions = BoundingBoxDimensions(content=curve_43)  # -> result, result_3, result_2
point_list_2 = PointList(Points=curve_middle_2, Size=Slider(0.05, range=0..1))

# ---- group: tower
curve_49 = Curve([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])
curve_50 = Curve([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])

# ----
mesh_3 = Mesh(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)

# ---- group: tower integral
curve_51 = Curve([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])
curve_52 = Curve([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])

# ---- group: new
curve_53 = Curve([<curve referenced from the Rhino model> x5])
curve_54 = Curve(<curve referenced from the Rhino model>)

# ----
panel_2 = Panel([bounding_box_dimensions.result, bounding_box_dimensions.result_3, bounding_box_dimensions.result_2])

# ----
# 3 layer 3feet
curve_55 = Curve([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])
curve_56 = Curve([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])

rhino_doc_dir = RhinoDocDir()  # -> rhino_doc_dir
# ---------- rhino_doc_dir: Python ----------
import scriptcontext as sc
from os import path

rhino_doc_dir = path.abspath(path.dirname(sc.doc.Path))
# ---------- end rhino_doc_dir ----------
curve_57 = Curve([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])

curve_58 = Curve(curve_51)
curve_59 = Curve(curve_52)

curve_middle_3 = CurveMiddle(Curve=curve_58)
length = Length(Curve=curve_58)
bar_graph = BarGraph(length, BarColor=RGB(255, 0, 90))
panel_3 = Panel(rhino_doc_dir)
file_name_please_end_with_json = Panel("tower_integral_clamp_collision.json")
mode = ValueList({"Contact": "_contact", "Adjust": "", "Layer": "layer"}, selected="Contact")
panel_4 = Panel("""17
18
15
16
11
12
13
14""")
point_list_3 = PointList(Points=curve_middle_3, Size="0.1")
panel_5 = Panel(length)
partition_list_2 = PartitionList(List=panel_4, Size="2")  # -> simplify(Chunks)

# ---- group: fixed bars
curve_60 = Curve(curve_57)

# ---- group: input line graph
curve_61 = Curve(curve_55)

# ----
panel_6 = Panel(partition_list_2)
file_name_please_end_with_json_2 = Panel("five_joint_clamp_collision.json")

bar_radius_m = Slider(0.01, range=0..0.1)
number = Number(bar_radius_m)
square = Square(Value=number)
pi = Pi(Factor=square)

file_name_please_end_with_json_3 = Panel("tower_integral_one_len.json")
ghpython_script = GhPythonScript(x=file_name_please_end_with_json_3, layer=Slider(0, range=0..10), mode=mode)  # -> out, a; inputs layer: Int32
# ---------- ghpython_script: Python ----------
if mode == "layer":
    suffix = '' if layer is None else '_layer_{}'.format(layer)
else:
    suffix = mode

if x.endswith('_MT.json'):
    a = x[:-8] + suffix + '.json'
elif x.endswith('.json'):
    a = x[:-5] + '_MT' + suffix + '.json'
else:
    a = x
# ---------- end ghpython_script ----------
file_name_please_end_with_json_4 = Panel("tower_integral_two_len.json")
file_name_please_end_with_json_5 = Panel("three_fork_topopt_vault.json")
file_name_please_end_with_json_6 = Panel("dodecahedron.json")
file_name_please_end_with_json_7 = Panel("hex_surface.json")
file_name_please_end_with_json_8 = Panel("geodesic_dome.json")
panel_7 = Panel(ghpython_script.a)
file_name_please_end_with_json_9 = Panel("alg_workflow_fixxx.json")
line_line_intersection_karamba3d = LineLineIntersectionKaramba3D(Line=curve_61, LimitDistance_m=0.005)  # -> IntersectionPoints, LineSubSegements
concatenate_2 = Concatenate(FragmentA=rhino_doc_dir, FragmentB="mt_results\", JoinSeparator="\")
series = Series(Start="0.1", Step="0.1", Count="20")
panel_8 = Panel(series)
file_name_please_end_with_json_10 = Panel("tower_integral_three_lens.json")

# ---- group: Issue and Chenmin's contact assignment script
ghpython_script_2 = GhPythonScript()  # -> out, line_list, pair_list, flat_list, points; inputs lines: list of Curve; disabled
# ---------- ghpython_script_2: Python ----------
import rhinoscriptsyntax as rs
import Rhino.Geometry as rg
from itertools import combinations

points = []
pair_list = []
line_list = []

for index,line in enumerate(lines):
    line_list.append(line)
    length = rg.Curve.GetLength(line)
    end_vertex = rg.Curve.PointAtLength(line,length)
    start_vertex = rg.Curve.PointAtLength(line,0)
    
    if end_vertex in points:
        pass
    else:
        points.append(end_vertex)
        
group = []

for idp, p in enumerate(points):
    for index,line in enumerate(lines):
    # get the line from a point and their index to a list(a,b,c)
        if rg.Curve.ClosestPoint(line,p,0.001)[0]:
            pair_list.append(index)

for i in range(0,len(pair_list)):
    group.append(pair_list[i:i+2])
    #choosetwo_list = list(combinations(group,2))
    #p_list.append(choosetwo_list)
    #print choosetwo_list
#print(group)

group_delete = group[2:len(group):3]

for delete in group_delete:
    group.remove(delete)
#print(group)

flat_list = [ num for sublist in group for num in sublist ]
print(flat_list)
# ---------- end ghpython_script_2 ----------
number_slider_2 = Slider(0.2, range=0..1)  # disabled
geometry = Geometry(ghpython_script_2.points)  # disabled
point_list_4 = PointList(Points=geometry, Size=number_slider_2)  # disabled
geometry_2 = Geometry(ghpython_script_2.line_list)  # disabled

# ----
file_name_please_end_with_json_11 = Panel("star_joint.json")
integer_9 = Integer([203, 202, 126, 125, 124, 123, 122, 121, 120, 119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])
integer_10 = Integer([197, 196, 195, 194, 193, 192, 164, 163, 162, 161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])
integer_11 = Integer([2, 0, 1, 5, 4, 3, 8, 7, 6])
file_name_please_end_with_json_12 = Panel("tower_integral_bar_len_series.json")

# ---- group: Issue and Chenmin's contact assignment script / bar indices display
list_length = ListLength(List=geometry_2)  # disabled
curve_middle_4 = CurveMiddle(Curve=geometry_2)  # disabled
series_2 = Series(Start=0, Step=1, Count=list_length)  # disabled
text_tag = TextTag(Location=curve_middle_4, Text=series_2)  # disabled

# ----
end_points = EndPoints(Curve=curve_61)  # -> Start, End
file_name_please_end_with_json_13 = Panel("0913_3domeYH_link.json")
the_distance_between_two_contact_bars_th = Panel("0.016")  # "the distance between two contact bars, this is related to the coupler's dimension [m]"

# ---- group: quick debug tool for copy and pasting results from console
L = GhPythonScript()  # -> lines, contact_info; disabled
# ---------- L: Python ----------
p = [[7.02237, 4.10361, 0.220422],
[7.69903, 2.65361, 0.1],
[7.78626, 2.85361, 0.221824],
[6.11234, 2.18917, -0.2],
[6.10764, 1.89805, -0.197726],
[7.21458, 4.16635, 0.293349],
]
ts = [[0, 1, 0.9, 0.1], 
[1, 2, 0.894346, 0.157499], 
[2, 0, 0.894311, 0.118454], 
]

#############################

import rhinoscriptsyntax as rs
import ghpythonlib.components as gh

lines = []
for id in range(int(len(p) / 2)):
    a = gh.ConstructPoint(*p[id * 2])
    b = gh.ConstructPoint(*p[2 * id + 1])
    print(a)
    print(b)
    lines.append(gh.Line(a, b))

from ghpythonlib.treehelpers import list_to_tree
contact_info = list_to_tree(ts, source=[])
# ---------- end L ----------
end_points_2 = EndPoints(Curve=L.lines)  # -> Start, End; disabled
point_3 = Point(end_points_2.Start)  # disabled
curve_62 = Curve(reparameterize(L.lines))  # disabled
panel_9 = Panel("0.01")  # disabled
list_item_5 = ListItem(List=L.contact_info, Index=0, Wrap=True)  # -> Item, Item1, Item2, Item3; disabled
pipe_2 = Pipe(Curve=curve_62, Radius=panel_9, Caps=1)  # -> flatten(Pipe); disabled
list_item_6 = ListItem(List=curve_62, Index=list_item_5.Item, Wrap=True)  # disabled
list_item_7 = ListItem(List=curve_62, Index=list_item_5.Item1, Wrap=True)  # disabled
evaluate_curve = EvaluateCurve(Curve=list_item_6, Parameter=list_item_5.Item2)  # -> Point, Tangent, Angle; disabled
evaluate_curve_2 = EvaluateCurve(Curve=list_item_7, Parameter=list_item_5.Item3)  # -> Point, Tangent, Angle; disabled
number_2 = Number(the_distance_between_two_contact_bars_th)  # disabled
distance = Distance(PointA=evaluate_curve.Point, PointB=evaluate_curve_2.Point)  # disabled
line_2 = Line(StartPoint=evaluate_curve.Point, EndPoint=evaluate_curve_2.Point)  # disabled
multiplication = Multiplication(A=panel_9, B=2)  # disabled
subtraction = Subtraction(A=distance, B=number_2, C=multiplication)  # disabled
bar_graph_2 = BarGraph(subtraction, BarColor=RGB(255, 0, 90))  # disabled
panel_10 = Panel(subtraction)  # disabled

# ----
removeduplicatepts = RemoveDuplicatePts(Points=end_points.Start, Tolerance=0.01)
entwine = Entwine(Branch00=integer_9, Branch01=integer_10, Branch02=integer_11, FlattenInputs=True)  # -> simplify(Result)
removeduplicatepts_2 = RemoveDuplicatePts(Points=line_line_intersection_karamba3d.IntersectionPoints, Tolerance=0.01)
concatenate_3 = Concatenate(FragmentA=concatenate_2, FragmentB=panel_7)
initial_trust_region_size_try_increasing = Panel("0.05")  # "initial trust region size (try increasing this if no solution can be found)"
clean_tree = CleanTree(RemoveNulls=True, RemoveInvalid=True, RemoveEmpty=True, Tree=entwine)
integer_12 = Integer(flatten(clean_tree))
create_set = CreateSet(List=flatten(integer_12))  # -> Set, Map
point_4 = Point(removeduplicatepts)
debug_mode = BooleanToggle(True)
construct_path_2 = ConstructPath(Indices=Slider(0, range=0..5))

# ---- group: input
curve_63 = Curve(curve_58)
curve_64 = Curve(curve_59)

# ----
point_5 = Point(removeduplicatepts_2)
tree_branch_3 = TreeBranch(Tree=clean_tree, Path=construct_path_2, MaintainPaths=True)
L_2 = GhPythonScript(file_path=concatenate_3, scale="1")  # -> out, lines, contact_residues, coupler_planes, coupler_segments
# ---------- L_2: Python ----------
import json
import ghpythonlib.components as gh
import Rhino.Geometry.Plane as Plane
import Rhino.Geometry.Vector3d as Vector3d
import Rhino.Geometry.Point3d as Point3d

with open(file_path) as json_data:
    data = json.load(json_data)

#print('Optimization: {}'.format('Success' if data['nstatus'] == 0 else 'Failed'))
ps = data['line_pt_pairs']
contact_id_pairs = data['contact_id_pairs']
#contact_t_pairs = data['contact_t_pairs']
#contact_residues = data['contact_residues']
lines = []
for p0,p1 in ps:
    a = gh.ConstructPoint(*p0)
    b = gh.ConstructPoint(*p1)
    a *= scale
    b *= scale
    lines.append(gh.Line(a, b))

coupler_segments = []
coupler_endpts = data.get('coupler_pt_pairs', [])
for p0,p1 in coupler_endpts:
    a = gh.ConstructPoint(*p0)
    b = gh.ConstructPoint(*p1)
    a *= scale
    b *= scale
    coupler_segments.append(gh.Line(a, b))

#Ci = []
#Cj = []
#ti = []
#tj = []
#for cid, t in zip(contact_id_pairs, contact_t_pairs):
#    Ci.append(lines[cid[0]])
#    Cj.append(lines[cid[1]])
#    ti.append(t[0])
#    tj.append(t[1])

coupler_planes = []
for coupler_data in data['half_couplers']:
    tform = coupler_data['pose']
    plane = Plane(Point3d(*[tform[i][3] for i in range(3)]),
                  Vector3d(*[tform[i][0] for i in range(3)]),
                  Vector3d(*[tform[i][1] for i in range(3)])
                  )
    coupler_planes.append(plane)
# ---------- end L_2 ----------

# ----
# Steps:
# 1. Draw line graph, indice support nodes
# 2. Write contact assignment, and tweak other parameters if needed
# 3. Change file name and click <write frame json file> button
# 4. In docker, run script
# 5. Refresh GH (middle key, ▶ button)
convergence_status = Panel(L_2.out)
write_frame_json_file = Button()

concatenate_4 = Concatenate(FragmentA=rhino_doc_dir, FragmentB="frame_assembly\", JoinSeparator="\")
panel_11 = Panel("""0,2,3
0,5,6
1,6,7
1,4,3
5,7,8
2,4,8""")

bounding_box_dimensions_2 = BoundingBoxDimensions(content=curve_63)  # -> result, result_3, result_2
bounding_box_dimension = Panel([bounding_box_dimensions_2.result, bounding_box_dimensions_2.result_3, bounding_box_dimensions_2.result_2])

pipe_3 = Pipe(Curve=L_2.coupler_segments, Radius="0.008", Caps=1)  # -> flatten(Pipe)
line_3 = Line(L_2.lines)
unit_x = UnitX(Factor=Slider(5.8, range=0..10))
ghpython_script_3 = GhPythonScript(mt_file_path=concatenate_3)  # -> out, opt_progression_image_path, contact_residue_image_path
# ---------- ghpython_script_3: Python ----------
import os

opt_progression_image_path = mt_file_path[:-8] + '_opt_progression.png'
contact_residue_image_path = mt_file_path[:-8] + '_contact_distance.png'
assert os.path.exists(opt_progression_image_path), opt_progression_image_path
assert os.path.exists(contact_residue_image_path), contact_residue_image_path
# ---------- end ghpython_script_3 ----------
rectangle = Rectangle({Plane=PlaneXY(2.775200726, -2.073535271, 0), Size=Domain2(u=-2.726157818..2.726157818, v=-1.943133272..1.943133272)})
pipe_4 = Pipe(Curve=L_2.lines, Radius=number, Caps=1)  # -> flatten(Pipe)
move_2 = Move(Geometry=rectangle, Motion=unit_x)  # -> Geometry, Transform
panel_12 = Panel(file_name_please_end_with_json_3)
mesh_pipe = MeshPipe(Curve=line_3, Radius=number, Accuracy=0.2, Rotation=0, Segments=10, Caps=2)
file_path = FilePath(concatenate_4)

# ---- group: Bar length after computation
length_2 = Length(Curve=L_2.lines)
bar_graph_3 = BarGraph(length_2, BarColor=RGB(255, 0, 90))
mass_addition = MassAddition(Input=length_2)  # -> Result, PartialResults
panel_13 = Panel(mass_addition.Result)

# ----
number_slider_3 = Slider(90, range=0..1000)  # disabled

# ---- group: one len
number_3 = Number([1, 1, 1, 1, 1, 1, 1, 1, 1, 1, 1, 1, 1, 1, 1, 1, 1, 1, 1, 1, 1, 1, 1, 1])

# ----
import_image = ImportImage(File=ghpython_script_3.opt_progression_image_path, Rectangle=rectangle)
import_image_2 = ImportImage(File=ghpython_script_3.contact_residue_image_path, Rectangle=move_2.Geometry)
geometry_3 = Geometry(pipe_4)

# ---- group: three_lens
number_4 = Number([1, 1, 0.5, 1, 1, 1, 1, 0.5, 0.5, 1, 1, 1.5, 1.5, 1, 1, 1, 1.5, 1, 1.5, 1, 1, 1, 1, 1.5])

# ----
mesh_4 = Mesh(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)  # disabled
sort_list = SortList(Keys=length_2)  # -> Keys, ValuesValuesA
ghpython_script_4 = GhPythonScript(x=length_2)  # -> out, a; inputs x: list
# ---------- ghpython_script_4: Python ----------
import Rhino.Geometry.Point3d as Point3d
import Grasshopper.DataTree as DataTree # Add, AddRange(list, GHPath(i, j))
import Grasshopper.Kernel.Data.GH_Path as GHPath
import System

from ghpythonlib.treehelpers import list_to_tree, tree_to_list

#print [0.1*int(10*a) for a in x]
print [float("{:.1f}".format(a)) for a in x]

a = ["["] +  ["{:.1f},".format(a) for a in x] + ["]"]
# ---------- end ghpython_script_4 ----------

# ---- group: varied lens
number_5 = Number([1, 1, 0.7, 0.4, 0.9, 0.6, 0.6, 0.6, 0.5, 0.8, 0.5, 1.1, 1, 1, 1, 1.1, 1, 1, 1.2, 1, 0.9, 0.6, 0.6, 0.9])

# ----
rotate = Rotate(Geometry=mesh_4, Angle=degrees(number_slider_3), Plane=PlaneXY(0, 0, 0))  # -> Geometry, Transform; disabled
mesh_5 = Mesh(import_image)
# when the contact residue is smaller than zero, there is collision between bars
mesh_6 = Mesh(import_image_2)

# ---- group: Viz for computed multi-tangent structure
geometry_4 = Geometry(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)
plane = Plane(L_2.coupler_planes)
mesh_7 = Mesh(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)
orient = Orient(Geometry=geometry_4, Source=PlaneXY(0, 0, 0), Target=plane)  # -> Geometry, Transform
custom_preview_2 = CustomPreview(Geometry=orient.Geometry, Material=ColourSwatch(SwatchColor=RGBA(255, 80, 219, 163)))
custom_preview_3 = CustomPreview(Geometry=geometry_3, Material=ColourSwatch(SwatchColor=RGBA(121, 214, 255, 187)))

# ----
panel_14 = Panel(sort_list.Keys)
panel_15 = Panel(number_5)
panel_16 = Panel(import_image)
panel_17 = Panel(ghpython_script_4.a)
geometry_5 = Geometry(orient.Geometry)

# ---- group: Configuration for the multi-tangent optimization
orientation_deviation_deg_new_bar_direct = Panel("15")  # "orientation deviation [deg] (new bar direction can at most form this angle with respect to the original direction)"
distance_restrict_the_clamps_position_to = Panel("0.2")  # "distance restrict the clamps' position to be closed to its input line graph's intersection point [m]"
position_deviation_m_node_can_move_in_a = Panel("0.1")  # "position deviation [m] (node can move in a bounding box +-value)"
smallest_distance_between_two_bars_that = Panel("0.03")  # "Smallest distance between two bars that are not in contact [m]"
available_bar_lengths = Panel("1.0")
initial_trust_region_size_try_increasing_2 = Panel("0.1")  # "initial trust region size (try increasing this if no solution can be found)"
collsion_distance_between_clamps_on_the = Panel("0.024")  # "collsion distance between clamps on the same bar [m]"
time_out_for_each_opt_iteration_sec = Panel("300")

# ---- group: Converting a line graph to a network representation
ghpython_script_5 = GhPythonScript(lines=curve_63, fixed_lines=curve_64, available_bar_lengths=available_bar_lengths)  # -> out, nodes, simplify(edges), fixed_edges; inputs lines: list of Line, fixed_lines: list of Line, available_bar_lengths: list
# ---------- ghpython_script_5: Python ----------
import Rhino.Geometry.Point3d as Point3d
import Grasshopper.DataTree as DataTree # Add, AddRange(list, GHPath(i, j))
import Grasshopper.Kernel.Data.GH_Path as GHPath
import System

from ghpythonlib.treehelpers import list_to_tree, tree_to_list

import Rhino
import rhinoscriptsyntax as rs
import scriptcontext as sc

def line_to_graph(lines, fixed_lines):
    # This dictionary will map unique points to indices
    point_dict = {}
    
    # These lists will hold the unique points and edges
    pts = []
    edges = []
    fixed_edges = []
    
    for line in lines:
        # Check if the start point is already in the dictionary
        for k, existing_pt in enumerate(pts):
            if existing_pt.DistanceTo(line.From) < 1e-6:
                v0 = k
                break
        else:
            pts.append(line.From)
            v0 = len(pts)-1
        
        for k, existing_pt in enumerate(pts):
            if existing_pt.DistanceTo(line.To) < 1e-6:
                v1 = k
                break
        else:
            pts.append(line.To)
            v1 = len(pts)-1
        
        edge = [v0, v1]
        edges.append(edge)
        
    for i, fl in enumerate(fixed_lines):
        v0, v1 = -1, -1
        for k, existing_pt in enumerate(pts):
            if existing_pt.DistanceTo(fl.From) < 1e-6:
                v0 = k
            if existing_pt.DistanceTo(fl.To) < 1e-6:
                v1 = k
        assert v0 >= 0 and v1 >= 0, "fixed line #{} has end points that do not belong to the line network!".format(i)
        edge = [v0, v1]
        fixed_edges.append(edges.index(edge))
    
    return pts, edges, fixed_edges

max_available_length = max(available_bar_lengths) if available_bar_lengths else 1e5
for i, line in enumerate(lines):
    if line.Length > max_available_length:
        raise ValueError("Line #{} has length {:.3f}, exceeding maximum available length {}. Please scale down your design.".format(i, line.Length, max_available_length))

nodes, edges, fixed_edges = line_to_graph(lines, fixed_lines)
edges = list_to_tree(edges, [])
# ---------- end ghpython_script_5 ----------

# ----
radians = Radians(Degrees=orientation_deviation_deg_new_bar_direct)

# ---- group: Configuration for the multi-tangent optimization (continued)
ghpython_script_6 = GhPythonScript(
    bar_available_lengths=available_bar_lengths,
    clamp_gap=the_distance_between_two_contact_bars_th,
    clamp_collision_dist=collsion_distance_between_clamps_on_the,
    bar_collision_distance=smallest_distance_between_two_bars_that,
    position_deviation=position_deviation_m_node_can_move_in_a,
    orientation_deviation=radians,
    clamp_t_bound=distance_restrict_the_clamps_position_to,
    inital_trust_region_size=initial_trust_region_size_try_increasing_2,
    time_out=time_out_for_each_opt_iteration_sec,
    debug=debug_mode,
    extra_collision_pairs=partition_list_2)  # -> out, mt_config; inputs bar_available_lengths: list, time_out: Int32, layers: tree of Int32, fixed_contact_pairs: tree of Int32, extra_collision_pairs: tree of Int32
# ---------- ghpython_script_6: Python ----------
import Rhino.Geometry.Point3d as Point3d
import Grasshopper.DataTree as DataTree # Add, AddRange(list, GHPath(i, j))
import Grasshopper.Kernel.Data.GH_Path as GHPath
import System

from ghpythonlib.treehelpers import list_to_tree, tree_to_list
from collections import namedtuple

ConfigData = namedtuple('ConfigData', ['data'])

data = {}
data['clamp_gap'] = clamp_gap

data["bar_available_lengths"] = bar_available_lengths or [1.0]

# trust region initial size
data["contactopt_trust_region_start"] = inital_trust_region_size or 0.05
data["adjustopt_trust_region_start"] = data["contactopt_trust_region_start"]

# collsion distance between clamps on the same bar
data["clamp_collision_dist"] = clamp_collision_dist or 0.024

# collision distance between bars
data["bar_collision_distance"] = bar_collision_distance or 0.02

# bars' origin position deviation bound
data["pos_devi"] = position_deviation or 0.05

# bars' orientation deviation bound
data["orient_devi"] = orientation_deviation or 10.0 / 180 * math.pi

# time out for each optimization iteration
data["time_out"] = time_out or 50

# this parameter is to restrict the clamps' position to be closed to its input line graph's intersection point.
data["clamp_t_bnd"] = clamp_t_bound or 0.1 # m

data["layers"] = tree_to_list(layers, lambda x:x)

data["fixed_contact_pairs"] = tree_to_list(fixed_contact_pairs, lambda x:x)

data["extra_collision_pairs"] = tree_to_list(extra_collision_pairs, lambda x:x)

data["debug_mode"] = debug

mt_config = ConfigData(data)
# ---------- end ghpython_script_6 ----------

# ----
panel_18 = Panel(ghpython_script_5.out)

# ---- group: line indices can be reordered by compas network
list_item_8 = ListItem(List=ghpython_script_5.edges, Index=0, Wrap=True)  # -> Item, Item1
list_item_9 = ListItem(List=ghpython_script_5.nodes, Index=list_item_8.Item1, Wrap=True)
list_item_10 = ListItem(List=ghpython_script_5.nodes, Index=list_item_8.Item, Wrap=True)
line_4 = Line(StartPoint=list_item_10, EndPoint=list_item_9)  # -> flatten(Line)

# ---- group: bar indices display
list_length_2 = ListLength(List=line_4)
curve_middle_5 = CurveMiddle(Curve=line_4)
series_3 = Series(Start=0, Step=1, Count=list_length_2)
text_tag_2 = TextTag(Location=curve_middle_5, Text=series_3)

# ----
selectablepreview = SelectablePreview(Geometry=line_4, lock=False, maintain=False, order=False)  # -> Geometry, Path, Index; disabled
set_difference = SetDifference(SetA=selectablepreview.Index, SetB=create_set.Set)
panel_19 = Panel(selectablepreview.Index)
curve_65 = Curve(selectablepreview.Geometry)

# ---- group: if your layers cover the entire shape, this should be empty
integer_13 = Integer(series_3)
create_set_2 = CreateSet(List=flatten(integer_13))  # -> Set, Map
create_set_3 = CreateSet(List=flatten(clean_tree))  # -> Set, Map
set_difference_2 = SetDifference(SetA=create_set_3.Set, SetB=create_set_2.Set)
panel_20 = Panel(set_difference_2)

# ----
list_item_11 = ListItem(List=line_4, Index=tree_branch_3, Wrap=True)

# ---- group: visualizing layers
list_item_12 = ListItem(List=line_4, Index=clean_tree, Wrap=True)
tree_statistics = TreeStatistics(Tree=clean_tree)  # -> Paths, graft(Length), Count
S = Shader([{diffuse=RGB(11, 125, 222), emission=RGB(3, 38, 67), shine=0.5, specular=RGB(255, 255, 255), transparency=0}, {diffuse=RGB(222, 37, 11), emission=RGB(67, 11, 3), shine=0.5, specular=RGB(255, 255, 255), transparency=0}, {diffuse=RGB(71, 222, 11), emission=RGB(21, 67, 3), shine=0.5, specular=RGB(255, 255, 255), transparency=0}, {diffuse=RGB(222, 194, 11), emission=RGB(67, 58, 3), shine=0.5, specular=RGB(255, 255, 255), transparency=0}])
repeat_data = RepeatData(Data=S, Length=tree_statistics.Count)  # -> simplify(graft(Data))
pipe_5 = Pipe(Curve=list_item_12, Radius=number, Caps=0)  # -> simplify(Pipe)
shift_paths = ShiftPaths(Data=pipe_5, Offset=-1)
custom_preview_4 = CustomPreview(Geometry=shift_paths, Shader=repeat_data)

# ---- group: Configuration for the multi-tangent optimization
# initial_value - dev <= P_xyz <= initial_value + dev
# (1 - ratio) * initial_L <= ||pi0 - pi1|| <= (1 + ratio) * initial_L
optimization_weight_id0_approx_original = Panel("""1.0
10.0""")  # "optimization weight | id0: approx original line graph, id1: contact energy"
shape_deviation_m = Slider(0.2, range=0..1)
ghpython_script_7 = GhPythonScript(
    clamp_gap=the_distance_between_two_contact_bars_th,
    clamp_collision_dist=collsion_distance_between_clamps_on_the,
    bar_collision_distance=smallest_distance_between_two_bars_that,
    opt_weights=optimization_weight_id0_approx_original,
    shape_deviation=shape_deviation_m,
    length_deviation_ratio=Slider(0.2, range=0..1))  # -> out, cpp_backend_config; inputs contact_inds: list of Int32, collision_inds: list of Int32, opt_weights: list
# ---------- ghpython_script_7: Python ----------
import Rhino.Geometry.Point3d as Point3d
import Grasshopper.DataTree as DataTree # Add, AddRange(list, GHPath(i, j))
import Grasshopper.Kernel.Data.GH_Path as GHPath
import System

from ghpythonlib.treehelpers import list_to_tree, tree_to_list
from collections import namedtuple

ConfigData = namedtuple('ConfigData', ['data'])

data = {}
data['max_tangent'] = None
data['clamp_gap'] = clamp_gap
data['clamp_collision_dist'] = clamp_collision_dist
data['bar_collision_distance'] = bar_collision_distance

assert len(contact_inds) % 2 == 0, 'contact_inds must be provided in pairs, thus the total number should be even!'
assert len(collision_inds) % 2 == 0, 'collision_inds must be provided in pairs, thus the total number should be even!'
data['contact_inds'] = contact_inds
data['collision_inds'] = collision_inds

data['opt_weights'] = opt_weights if len(opt_weights) > 2 else opt_weights + [0.0]
data['shape_deviation'] = shape_deviation
data['length_deviation_ratio'] = length_deviation_ratio

cpp_backend_config = ConfigData(data)
# ---------- end ghpython_script_7 ----------

# ----
list_indices = ListIndices(List=ghpython_script_5.nodes)
point_6 = Point(ghpython_script_5.nodes)
text_tag_3 = TextTag(Location=ghpython_script_5.nodes, Text=list_indices)
list_item_13 = ListItem(List=point_6, Index=Slider(0, range=0..3), Wrap=True)

# ---- group: Bar length before computation
length_3 = Length(Curve=line_4)
bar_graph_4 = BarGraph(length_3, BarColor=RGB(255, 0, 90))
mass_addition_2 = MassAddition(Input=length_3)  # -> Result, PartialResults
panel_21 = Panel(mass_addition_2.Result)

# ----
number_6 = Number(length_3)
ghpython_script_8 = GhPythonScript(
    write=write_frame_json_file,
    indent="1",
    file_path=file_path,
    file_name=file_name_please_end_with_json_3,
    points=ghpython_script_5.nodes,
    connectivity=ghpython_script_5.edges,
    fixed_line_ids=ghpython_script_5.fixed_edges,
    crossec_area=pi,
    mt_config=ghpython_script_6.mt_config,
    cpp_backend_config=ghpython_script_7.cpp_backend_config)  # -> out, a; inputs write: Boolean, indent: Int32, points: list of Point3d, connectivity: tree, fixed_line_ids: list of Int32, crossec_area: list
# ---------- ghpython_script_8: Python ----------
import Rhino.Geometry.Point3d as Point3d
import Grasshopper.DataTree as DataTree # Add, AddRange(list, GHPath(i, j))
import Grasshopper.Kernel.Data.GH_Path as GHPath
import System

import os
import json
import math
from collections import defaultdict
from ghpythonlib.treehelpers import list_to_tree, tree_to_list
#########################

if write:
    data = {}
    
    data['nodes'] = []
    for i, pt in enumerate(points):
        pt_data = {
        'is_grounded':False,
        'node_ind' : i,
        'point' : [pt.X, pt.Y, pt.Z]
        }
        data['nodes'].append(pt_data)
        
    
    e_con = tree_to_list(connectivity, lambda x:x)
    data['elements'] = []
    for i, e in enumerate(e_con):
        e_data = {
            'end_node_inds' : e,
            'cross_secs_ind' : i if len(crossec_area) == len(e_con) else 0,
        }
        data['elements'].append(e_data)
    
#    for gpt in grounded_pts:
#        for i, pt in enumerate(points):
#            if gpt.DistanceTo(pt) < 1e-8:
#                data['nodes'][i]['is_grounded'] = True
#                break
    data['fixed_element_ids'] = fixed_line_ids
    
    if len(crossec_area) == 1:
        data['cross_secs'] = [{
            'A' : crossec_area[0],
            'radius' : math.sqrt(crossec_area[0]/math.pi),
        }]
    else:
        assert len(crossec_area) == len(e_con)
        data['cross_secs'] = [{
            'A' : cs,
            'radius' : math.sqrt(cs/math.pi),
        } for cs in crossec_area]

    data["materials"] = [
        {
          "E": 1290000,
          "G12": 460714.2857142857,
          "density": 0.58
        }
    ]
    
    data['mt_config'] = mt_config
    data['cpp_backend_config'] = cpp_backend_config
    
    with open(os.path.join(file_path, file_name), 'w') as f:
        json.dump(data, f, indent=indent)
# ---------- end ghpython_script_8 ----------
panel_22 = Panel(ghpython_script_5.edges)
pie_chart = PieChart(length_3)

# ---- group: viz for line graph
# lines
curve_66 = Curve(line_4)
pipe_6 = Pipe(Curve=curve_66, Radius=number, Caps=0)  # -> flatten(Pipe)
custom_preview_5 = CustomPreview(Geometry=curve_66, Material=ColourSwatch(SwatchColor=RGB(109, 103, 255)))

# ----
panel_23 = Panel(ghpython_script_8.out)

# ---- group: fixed edges
list_item_14 = ListItem(List=pipe_4, Index=ghpython_script_5.fixed_edges, Wrap=True)

# ==== cluster BoundingBoxDimensions: Bounding Box Dimensions
content = ClusterInput()
bounding_box = BoundingBox(Content=content, Plane=PlaneXY(0, 0, 0), UnionBox=True)  # -> Box, Box_2
deconstruct_box = DeconstructBox(Box=bounding_box.Box)  # -> Plane, X, Y, Z
deconstruct_domain = DeconstructDomain(Domain=deconstruct_box.X)  # -> Start, End
deconstruct_domain_2 = DeconstructDomain(Domain=deconstruct_box.Z)  # -> Start, End
deconstruct_domain_3 = DeconstructDomain(Domain=deconstruct_box.Y)  # -> Start, End
subtraction = Subtraction(A=deconstruct_domain.End, B=deconstruct_domain.Start)
subtraction_2 = Subtraction(A=deconstruct_domain_2.End, B=deconstruct_domain_2.Start)
subtraction_3 = Subtraction(A=deconstruct_domain_3.End, B=deconstruct_domain_3.Start)
result = ClusterOutput(subtraction)
result_2 = ClusterOutput(subtraction_2)
result_3 = ClusterOutput(subtraction_3)
