# Grasshopper definition parse_mt_structure_json_ziqi.gh (Grasshopper 1.0.7)
# plug-ins: Karamba3D, Kangaroo2 Components, Pufferfish, SelectablePreview

layer0 = Curve([<curve referenced from the Rhino model> x32])
layer1 = Curve([<curve referenced from the Rhino model> x32])
layer2 = Curve([<curve referenced from the Rhino model> x53])
layer3 = Curve([<curve referenced from the Rhino model> x48])
layer5 = Curve([<curve referenced from the Rhino model> x33])
layer6 = Curve([<curve referenced from the Rhino model> x42])
layer4 = Curve([<curve referenced from the Rhino model> x33])
layer8 = Curve([<curve referenced from the Rhino model> x35])
layerfull = Curve([<curve referenced from the Rhino model> x183])
layer9 = Curve([<curve referenced from the Rhino model> x35])
layer10 = Curve([<curve referenced from the Rhino model> x43])
layer7 = Curve([<curve referenced from the Rhino model> x23])
layer11 = Curve([<curve referenced from the Rhino model> x23])

# ----
# domefoot_testB
curve = Curve([<curve referenced from the Rhino model> x453])
curve_2 = Curve([<curve referenced from the Rhino model> x8])

curve_middle = CurveMiddle(Curve=curve)
item = ListItem(List=curve, Index=Slider(452, range=0..1000), Wrap=True)
length = Length(Curve=item)
point_list = PointList(Points=curve_middle, Size=Slider(0.05, range=0..1))
length_2 = Length(Curve=curve)
bar_graph = BarGraph(length_2, BarColor=RGB(255, 0, 90))
selectablepreview = SelectablePreview(Geometry=<missing>, lock=False, maintain=False, order=False)  # -> Geometry, Path, Index
selectablepreview_2 = SelectablePreview(Geometry=<missing>, lock=False, maintain=False, order=False)  # -> Geometry, Path, Index

# ---- group: grounded nodes (these nodes' positions will not be changed in optimization)
point = Point([Point(7.699029521, 2.653613626, 0.1), Point(5.91234253, 1.989166058, 0), Point(7.022369958, 4.103605584, 0)])

# ---- group: input line graph
curve_3 = Curve(curve)

# ----
bar_radius_m = Slider(0.01, range=0..0.1)
number = Number(bar_radius_m)
square = Square(Value=number)
pi = Pi(Factor=square)

list_item = ListItem(List=curve_3, Index=0, Wrap=True)
file_name_please_end_with_json = Panel("0829_arch.json")

# ---- group: input line graph
curve_4 = Curve(curve_3)

# ---- group: fixed bars
curve_5 = Curve(curve_2)

# ----
line_line_intersection_karamba3d = LineLineIntersectionKaramba3D(Line=<missing>, LimitDistance_m=0.005)  # -> IntersectionPoints, LineSubSegements

# ---- group: Issue and Chenmin's contact assignment script
ghpython_script = GhPythonScript()  # -> out, line_list, pair_list, flat_list, points; inputs lines: list of Curve; disabled
# ---------- ghpython_script: Python ----------
import rhinoscriptsyntax as rs
import Rhino.Geometry as rg
from itertools import combinations

points = []
pair_list = []
line_list = []

for index,line in enumerate(lines):
    line_list.append(line)
    length = rg.Curve.GetLength(line)
    end_vertex = rg.Curve.PointAtLength(line,length)
    start_vertex = rg.Curve.PointAtLength(line,0)
    
    if end_vertex in points:
        pass
    else:
        points.append(end_vertex)
        
group = []

for idp, p in enumerate(points):
    for index,line in enumerate(lines):
    # get the line from a point and their index to a list(a,b,c)
        if rg.Curve.ClosestPoint(line,p,0.001)[0]:
            pair_list.append(index)

for i in range(0,len(pair_list)):
    group.append(pair_list[i:i+2])
    #choosetwo_list = list(combinations(group,2))
    #p_list.append(choosetwo_list)
    #print choosetwo_list
#print(group)

group_delete = group[2:len(group):3]

for delete in group_delete:
    group.remove(delete)
#print(group)

flat_list = [ num for sublist in group for num in sublist ]
print(flat_list)
# ---------- end ghpython_script ----------
number_slider = Slider(0.2, range=0..1)  # disabled
geometry = Geometry(ghpython_script.points)  # disabled
point_list_2 = PointList(Points=geometry, Size=number_slider)  # disabled
geometry_2 = Geometry(ghpython_script.line_list)  # disabled

# ---- group: Issue and Chenmin's contact assignment script / bar indices display
list_length = ListLength(List=geometry_2)  # disabled
curve_middle_2 = CurveMiddle(Curve=geometry_2)  # disabled
series = Series(Start=0, Step=1, Count=list_length)  # disabled
text_tag = TextTag(Location=curve_middle_2, Text=series)  # disabled

# ----
end_points = EndPoints(Curve=curve_4)  # -> Start, End
removeduplicatepts = RemoveDuplicatePts(Points=end_points.Start, Tolerance=0.01)
initial_trust_region_size_try_increasing = Panel("0.05")  # "initial trust region size (try increasing this if no solution can be found)"

# ---- group: input
curve_6 = Curve(curve_5)
curve_7 = Curve(curve_4)

# ----
point_2 = Point(removeduplicatepts)
debug_mode = BooleanToggle(True)
panel = Panel("""0,2,3
0,5,6
1,6,7
1,4,3
5,7,8
2,4,8""")

bounding_box_dimensions = BoundingBoxDimensions(content=curve_7)  # -> result, result_3, result_2
bounding_box_dimension = Panel([bounding_box_dimensions.result, bounding_box_dimensions.result_3, bounding_box_dimensions.result_2])

list_indices = ListIndices(List=<missing>)
rhino_doc_dir = RhinoDocDir()  # -> rhino_doc_dir
# ---------- rhino_doc_dir: Python ----------
import scriptcontext as sc
from os import path

rhino_doc_dir = path.abspath(path.dirname(sc.doc.Path))
# ---------- end rhino_doc_dir ----------
concatenate = Concatenate(FragmentA=rhino_doc_dir, FragmentB="frame_assembly/", JoinSeparator="/")
file_path = FilePath(concatenate)
panel_2 = Panel(rhino_doc_dir)
ghpython_script_2 = GhPythonScript(x=file_name_please_end_with_json)  # -> out, a
# ---------- ghpython_script_2: Python ----------
if x.endswith('_MT.json'):
    a = x[:-8] + '.json'
elif x.endswith('.json'):
    a = x[:-5] + '_MT_contact.json'
else:
    a = x
# ---------- end ghpython_script_2 ----------
panel_3 = Panel(ghpython_script_2.a)
concatenate_2 = Concatenate(FragmentA=rhino_doc_dir, FragmentB="mt_results/", JoinSeparator="/")
concatenate_3 = Concatenate(FragmentA=concatenate_2, FragmentB=panel_3)
L = GhPythonScript(file_path=concatenate_3, scale="1")  # -> out, lines, contact_residues, coupler_planes, ti, tj; disabled
# ---------- L: Python ----------
import json
import ghpythonlib.components as gh
import Rhino.Geometry.Plane as Plane
import Rhino.Geometry.Vector3d as Vector3d
import Rhino.Geometry.Point3d as Point3d

with open(file_path) as json_data:
    data = json.load(json_data)

#print('Optimization: {}'.format('Success' if data['nstatus'] == 0 else 'Failed'))
ps = data['line_pt_pairs']
contact_id_pairs = data['contact_id_pairs']
#contact_t_pairs = data['contact_t_pairs']
#contact_residues = data['contact_residues']
lines = []
for p0,p1 in ps:
    a = gh.ConstructPoint(*p0)
    b = gh.ConstructPoint(*p1)
    a *= scale
    b *= scale
    lines.append(gh.Line(a, b))

coupler_segments = []
coupler_endpts = data.get('coupler_pt_pairs', [])
for p0,p1 in coupler_endpts:
    a = gh.ConstructPoint(*p0)
    b = gh.ConstructPoint(*p1)
    a *= scale
    b *= scale
    coupler_segments.append(gh.Line(a, b))

#Ci = []
#Cj = []
#ti = []
#tj = []
#for cid, t in zip(contact_id_pairs, contact_t_pairs):
#    Ci.append(lines[cid[0]])
#    Cj.append(lines[cid[1]])
#    ti.append(t[0])
#    tj.append(t[1])

coupler_planes = []
for coupler_data in data['half_couplers']:
    tform = coupler_data['pose']
    plane = Plane(Point3d(*[tform[i][3] for i in range(3)]),
                  Vector3d(*[tform[i][0] for i in range(3)]),
                  Vector3d(*[tform[i][1] for i in range(3)])
                  )
    coupler_planes.append(plane)
# ---------- end L ----------

# ----
# Steps:
# 1. Draw line graph, indice support nodes
# 2. Write contact assignment, and tweak other parameters if needed
# 3. Change file name and click <write frame json file> button
# 4. In docker, run script
# 5. Refresh GH (middle key, ▶ button)
convergence_status = Panel(L.out)
write_frame_json_file = Button()

pipe = Pipe(Curve=L.lines, Radius=number, Caps=1)  # -> flatten(Pipe)
geometry_3 = Geometry(pipe)
unit_x = UnitX(Factor=Slider(5.8, range=0..10))
ghpython_script_3 = GhPythonScript(mt_file_path=concatenate_3)  # -> out, opt_progression_image_path, contact_residue_image_path
# ---------- ghpython_script_3: Python ----------
import os

opt_progression_image_path = mt_file_path[:-8] + '_opt_progression.png'
contact_residue_image_path = mt_file_path[:-8] + '_contact_distance.png'
assert os.path.exists(opt_progression_image_path), opt_progression_image_path
assert os.path.exists(contact_residue_image_path), contact_residue_image_path
# ---------- end ghpython_script_3 ----------
rectangle = Rectangle({Plane=PlaneXY(2.775200726, -2.073535271, 0), Size=Domain2(u=-2.726157818..2.726157818, v=-1.943133272..1.943133272)})
move = Move(Geometry=rectangle, Motion=unit_x)  # -> Geometry, Transform

# ---- group: Bar length before computation
length_3 = Length()
bar_graph_2 = BarGraph(length_3, BarColor=RGB(255, 0, 90))
mass_addition = MassAddition(Input=length_3)  # -> Result, PartialResults
panel_4 = Panel(mass_addition.Result)

# ---- group: Bar length after computation
length_4 = Length(Curve=L.lines)
bar_graph_3 = BarGraph(length_4, BarColor=RGB(255, 0, 90))
mass_addition_2 = MassAddition(Input=length_4)  # -> Result, PartialResults
panel_5 = Panel(mass_addition_2.Result)

# ----
import_image = ImportImage(File=ghpython_script_3.opt_progression_image_path, Rectangle=rectangle)
import_image_2 = ImportImage(File=ghpython_script_3.contact_residue_image_path, Rectangle=move.Geometry)
mesh = Mesh(import_image)
# when the contact residue is smaller than zero, there is collision between bars
mesh_2 = Mesh(import_image_2)

# ---- group: Viz for computed multi-tangent structure
plane = Plane(L.coupler_planes)
mesh_3 = Mesh(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)
orient = Orient(Geometry=mesh_3, Source=PlaneXY(0, 0, 0), Target=plane)  # -> Geometry, Transform
custom_preview = CustomPreview(Geometry=pipe, Material=ColourSwatch(SwatchColor=RGB(253, 88, 255)))
custom_preview_2 = CustomPreview(Geometry=orient.Geometry, Material=ColourSwatch(SwatchColor=RGB(145, 146, 148)))

# ----
geometry_4 = Geometry(orient.Geometry)
panel_6 = Panel(import_image)

# ---- group: quick debug tool for copy and pasting results from console
L_2 = GhPythonScript()  # -> lines, contact_info; disabled
# ---------- L_2: Python ----------
p = [[7.02237, 4.10361, 0.220422],
[7.69903, 2.65361, 0.1],
[7.78626, 2.85361, 0.221824],
[6.11234, 2.18917, -0.2],
[6.10764, 1.89805, -0.197726],
[7.21458, 4.16635, 0.293349],
]
ts = [[0, 1, 0.9, 0.1], 
[1, 2, 0.894346, 0.157499], 
[2, 0, 0.894311, 0.118454], 
]

#############################

import rhinoscriptsyntax as rs
import ghpythonlib.components as gh

lines = []
for id in range(int(len(p) / 2)):
    a = gh.ConstructPoint(*p[id * 2])
    b = gh.ConstructPoint(*p[2 * id + 1])
    print(a)
    print(b)
    lines.append(gh.Line(a, b))

from ghpythonlib.treehelpers import list_to_tree
contact_info = list_to_tree(ts, source=[])
# ---------- end L_2 ----------
end_points_2 = EndPoints(Curve=L_2.lines)  # -> Start, End; disabled
point_3 = Point(end_points_2.Start)  # disabled
curve_8 = Curve(reparameterize(L_2.lines))  # disabled
panel_7 = Panel("0.01")  # disabled
list_item_2 = ListItem(List=L_2.contact_info, Index=0, Wrap=True)  # -> Item, Item1, Item2, Item3; disabled
pipe_2 = Pipe(Curve=curve_8, Radius=panel_7, Caps=1)  # -> flatten(Pipe); disabled
list_item_3 = ListItem(List=curve_8, Index=list_item_2.Item, Wrap=True)  # disabled
list_item_4 = ListItem(List=curve_8, Index=list_item_2.Item1, Wrap=True)  # disabled
evaluate_curve = EvaluateCurve(Curve=list_item_3, Parameter=list_item_2.Item2)  # -> Point, Tangent, Angle; disabled
evaluate_curve_2 = EvaluateCurve(Curve=list_item_4, Parameter=list_item_2.Item3)  # -> Point, Tangent, Angle; disabled
line = Line(StartPoint=evaluate_curve.Point, EndPoint=evaluate_curve_2.Point)  # disabled
distance = Distance(PointA=evaluate_curve.Point, PointB=evaluate_curve_2.Point)  # disabled
multiplication = Multiplication(A=panel_7, B=2)  # disabled

# ---- group: Configuration for the multi-tangent optimization
orientation_deviation_deg_new_bar_direct = Panel("10")  # "orientation deviation [deg] (new bar direction can at most form this angle with respect to the original direction)"
position_deviation_m_node_can_move_in_a = Panel("0.05")  # "position deviation [m] (node can move in a bounding box +-value)"
distance_restrict_the_clamps_position_to = Panel("0.05")  # "distance restrict the clamps' position to be closed to its input line graph's intersection point [m]"
smallest_distance_between_two_bars_that = Panel("0.020")  # "Smallest distance between two bars that are not in contact [m]"
the_distance_between_two_contact_bars_th = Panel("0.016")  # "the distance between two contact bars, this is related to the coupler's dimension [m]"
initial_trust_region_size_try_increasing_2 = Panel("0.05")  # "initial trust region size (try increasing this if no solution can be found)"
collsion_distance_between_clamps_on_the = Panel("0.024")  # "collsion distance between clamps on the same bar [m]"
time_out_for_each_opt_iteration_sec = Panel("200")
available_bar_lengths = Panel("1")

# ---- group: quick debug tool for copy and pasting results from console (continued)
number_2 = Number(the_distance_between_two_contact_bars_th)  # disabled
subtraction = Subtraction(A=distance, B=number_2, C=multiplication)  # disabled
bar_graph_4 = BarGraph(subtraction, BarColor=RGB(255, 0, 90))  # disabled
panel_8 = Panel(subtraction)  # disabled

# ---- group: Converting a line graph to a network representation
ghpython_script_4 = GhPythonScript(lines=curve_7, fixed_lines=curve_6, available_bar_lengths=available_bar_lengths)  # -> out, nodes, simplify(edges), fixed_edges; inputs lines: list of Line, fixed_lines: list of Line, available_bar_lengths: list
# ---------- ghpython_script_4: Python ----------
import Rhino.Geometry.Point3d as Point3d
import Grasshopper.DataTree as DataTree # Add, AddRange(list, GHPath(i, j))
import Grasshopper.Kernel.Data.GH_Path as GHPath
import System

from ghpythonlib.treehelpers import list_to_tree, tree_to_list

import Rhino
import rhinoscriptsyntax as rs
import scriptcontext as sc

def line_to_graph(lines, fixed_lines):
    # This dictionary will map unique points to indices
    point_dict = {}
    
    # These lists will hold the unique points and edges
    pts = []
    edges = []
    fixed_edges = []
    
    for line in lines:
        # Check if the start point is already in the dictionary
        for k, existing_pt in enumerate(pts):
            if existing_pt.DistanceTo(line.From) < 1e-6:
                v0 = k
                break
        else:
            pts.append(line.From)
            v0 = len(pts)-1
        
        for k, existing_pt in enumerate(pts):
            if existing_pt.DistanceTo(line.To) < 1e-6:
                v1 = k
                break
        else:
            pts.append(line.To)
            v1 = len(pts)-1
        
        edge = [v0, v1]
        edges.append(edge)
        
    for i, fl in enumerate(fixed_lines):
        v0, v1 = -1, -1
        for k, existing_pt in enumerate(pts):
            if existing_pt.DistanceTo(fl.From) < 1e-6:
                v0 = k
            if existing_pt.DistanceTo(fl.To) < 1e-6:
                v1 = k
        assert v0 >= 0 and v1 >= 0, "fixed line #{} has end points that do not belong to the line network!".format(i)
        edge = [v0, v1]
        fixed_edges.append(edges.index(edge))
    
    return pts, edges, fixed_edges

max_available_length = max(available_bar_lengths) if available_bar_lengths else 1e5
for i, line in enumerate(lines):
    if line.Length > max_available_length:
        raise ValueError("Line #{} has length {:.3f}, exceeding maximum available length {}. Please scale down your design.".format(i, line.Length, max_available_length))

nodes, edges, fixed_edges = line_to_graph(lines, fixed_lines)
edges = list_to_tree(edges, [])
# ---------- end ghpython_script_4 ----------

# ----
edges = Data(simplify(flatten(ghpython_script_4.edges)))
nodes = Data(ghpython_script_4.nodes)
ghpython_script_5 = GhPythonScript(nodes=nodes, edges=edges, select_lines=layerfull)  # -> out, select_edge_inds; inputs nodes: list of Point3d, edges: list of Int32, select_lines: list of Line
# ---------- ghpython_script_5: Python ----------
import Rhino.Geometry.Point3d as Point3d
import Grasshopper.DataTree as DataTree # Add, AddRange(list, GHPath(i, j))
import Grasshopper.Kernel.Data.GH_Path as GHPath
import System

from ghpythonlib.treehelpers import list_to_tree, tree_to_list

import Rhino
import rhinoscriptsyntax as rs
import scriptcontext as sc

def find_select_lines(pts, edges, select_lines):
    # This dictionary will map unique points to indices
    select_edge_inds = []
    for i, fl in enumerate(select_lines):
        v0, v1 = -1, -1
        for k, existing_pt in enumerate(pts):
            if existing_pt.DistanceTo(fl.From) < 1e-6:
                v0 = k
            if existing_pt.DistanceTo(fl.To) < 1e-6:
                v1 = k
        assert v0 >= 0 and v1 >= 0, "fixed line #{} has end points that do not belong to the line network!".format(i)
        edge = [v0, v1]
        edge_index = edges.index(edge)
        if edge_index not in select_edge_inds:
            select_edge_inds.append(edge_index)
    
    return select_edge_inds

E = [[edges[id * 2], edges[2 * id + 1]] for id in range(int(len(edges)/2))]

select_edge_inds = find_select_lines(nodes, E, select_lines)
# ---------- end ghpython_script_5 ----------
ghpython_script_6 = GhPythonScript(nodes=nodes, edges=edges, select_lines=layer3)  # -> out, select_edge_inds; inputs nodes: list of Point3d, edges: list of Int32, select_lines: list of Line; same code as ghpython_script_5
ghpython_script_7 = GhPythonScript(nodes=nodes, edges=edges, select_lines=layer11)  # -> out, select_edge_inds; inputs nodes: list of Point3d, edges: list of Int32, select_lines: list of Line; same code as ghpython_script_5
ghpython_script_8 = GhPythonScript(nodes=nodes, edges=edges, select_lines=layer9)  # -> out, select_edge_inds; inputs nodes: list of Point3d, edges: list of Int32, select_lines: list of Line; same code as ghpython_script_5
ghpython_script_9 = GhPythonScript(nodes=nodes, edges=edges, select_lines=layer10)  # -> out, select_edge_inds; inputs nodes: list of Point3d, edges: list of Int32, select_lines: list of Line; same code as ghpython_script_5
ghpython_script_10 = GhPythonScript(nodes=nodes, edges=edges, select_lines=layer2)  # -> out, select_edge_inds; inputs nodes: list of Point3d, edges: list of Int32, select_lines: list of Line; same code as ghpython_script_5
ghpython_script_11 = GhPythonScript(nodes=nodes, edges=edges, select_lines=layer7)  # -> out, select_edge_inds; inputs nodes: list of Point3d, edges: list of Int32, select_lines: list of Line; same code as ghpython_script_5
ghpython_script_12 = GhPythonScript(nodes=nodes, edges=edges, select_lines=layer5)  # -> out, select_edge_inds; inputs nodes: list of Point3d, edges: list of Int32, select_lines: list of Line; same code as ghpython_script_5
ghpython_script_13 = GhPythonScript(nodes=nodes, edges=edges, select_lines=layer6)  # -> out, select_edge_inds; inputs nodes: list of Point3d, edges: list of Int32, select_lines: list of Line; same code as ghpython_script_5
ghpython_script_14 = GhPythonScript(nodes=nodes, edges=edges, select_lines=layer8)  # -> out, select_edge_inds; inputs nodes: list of Point3d, edges: list of Int32, select_lines: list of Line; same code as ghpython_script_5
ghpython_script_15 = GhPythonScript(nodes=nodes, edges=edges, select_lines=layer1)  # -> out, select_edge_inds; inputs nodes: list of Point3d, edges: list of Int32, select_lines: list of Line; same code as ghpython_script_5
ghpython_script_16 = GhPythonScript(nodes=nodes, edges=edges, select_lines=layer4)  # -> out, select_edge_inds; inputs nodes: list of Point3d, edges: list of Int32, select_lines: list of Line; same code as ghpython_script_5
ghpython_script_17 = GhPythonScript(nodes=nodes, edges=edges, select_lines=layer0)  # -> out, select_edge_inds; inputs nodes: list of Point3d, edges: list of Int32, select_lines: list of Line; same code as ghpython_script_5
data = Data(ghpython_script_4.fixed_edges)
merge = Merge(
    Data1=data,
    Data2=ghpython_script_17.select_edge_inds,
    Data3=ghpython_script_15.select_edge_inds,
    Data4=ghpython_script_6.select_edge_inds,
    Data5=ghpython_script_10.select_edge_inds)
remain_edges = GhPythonScript(edges=ghpython_script_5.select_edge_inds, select_edge_inds=merge)  # -> remain_edge_inds; inputs edges: list of Int32, select_edge_inds: list of Int32
# ---------- remain_edges: Python ----------
import Rhino.Geometry.Point3d as Point3d
import Grasshopper.DataTree as DataTree # Add, AddRange(list, GHPath(i, j))
import Grasshopper.Kernel.Data.GH_Path as GHPath
import System

from ghpythonlib.treehelpers import list_to_tree, tree_to_list

import Rhino
import rhinoscriptsyntax as rs
import scriptcontext as sc

E = edges

remain_edge_inds = []
for id in edges:
    if id not in select_edge_inds:
        remain_edge_inds.append(id)
# ---------- end remain_edges ----------
python = GhPythonScript(
    L0=ghpython_script_17.select_edge_inds,
    L1=ghpython_script_15.select_edge_inds,
    L2=ghpython_script_10.select_edge_inds,
    L3=ghpython_script_6.select_edge_inds,
    L4=remain_edges,
    L5=ghpython_script_16.select_edge_inds,
    L6=ghpython_script_12.select_edge_inds,
    L7=ghpython_script_13.select_edge_inds,
    L8=ghpython_script_11.select_edge_inds,
    L9=ghpython_script_14.select_edge_inds,
    L10=ghpython_script_8.select_edge_inds,
    L11=ghpython_script_9.select_edge_inds,
    L12=ghpython_script_7.select_edge_inds)  # -> out, a; inputs L0: list, L1: list, L2: list, L3: list, L4: list, L5: list, L6: list, L7: list, L8: list, L9: list, L10: list, L11: list, L12: list
# ---------- python: Python ----------
__author__ = "wangziqi"

import rhinoscriptsyntax as rs

a = [L0, L1, L2, L3, L4, L5, L6, L7, L8, L9, L10, L11, L12]
# ---------- end python ----------
item_2 = ListItem(List=curve, Index=remain_edges, Wrap=True)
radians = Radians(Degrees=orientation_deviation_deg_new_bar_direct)

# ---- group: Configuration for the multi-tangent optimization (continued)
ghpython_script_18 = GhPythonScript(
    bar_available_lengths=available_bar_lengths,
    clamp_gap=the_distance_between_two_contact_bars_th,
    clamp_collision_dist=collsion_distance_between_clamps_on_the,
    bar_collision_distance=smallest_distance_between_two_bars_that,
    position_deviation=position_deviation_m_node_can_move_in_a,
    orientation_deviation=radians,
    clamp_t_bound=distance_restrict_the_clamps_position_to,
    inital_trust_region_size=initial_trust_region_size_try_increasing_2,
    time_out=time_out_for_each_opt_iteration_sec,
    debug=debug_mode,
    layers=python.a)  # -> out, mt_config; inputs bar_available_lengths: list, time_out: Int32, layers: list
# ---------- ghpython_script_18: Python ----------
import Rhino.Geometry.Point3d as Point3d
import Grasshopper.DataTree as DataTree # Add, AddRange(list, GHPath(i, j))
import Grasshopper.Kernel.Data.GH_Path as GHPath
import System

from ghpythonlib.treehelpers import list_to_tree, tree_to_list
from collections import namedtuple

ConfigData = namedtuple('ConfigData', ['data'])

data = {}
data['clamp_gap'] = clamp_gap

data["bar_available_lengths"] = bar_available_lengths or [1.0]

# trust region initial size
data["contactopt_trust_region_start"] = inital_trust_region_size or 0.05
data["adjustopt_trust_region_start"] = data["contactopt_trust_region_start"]

# collsion distance between clamps on the same bar
data["clamp_collision_dist"] = clamp_collision_dist or 0.024

# collision distance between bars
data["bar_collision_distance"] = bar_collision_distance or 0.02

# bars' origin position deviation bound
data["pos_devi"] = position_deviation or 0.05

# bars' orientation deviation bound
data["orient_devi"] = orientation_deviation or 10.0 / 180 * math.pi

# time out for each optimization iteration
data["time_out"] = time_out or 50

# this parameter is to restrict the clamps' position to be closed to its input line graph's intersection point.
data["clamp_t_bnd"] = clamp_t_bound or 0.1 # m

data["layers"] = layers

data["debug_mode"] = debug

mt_config = ConfigData(data)
# ---------- end ghpython_script_18 ----------

# ---- group: line indices can be reordered by compas network
list_item_5 = ListItem(List=ghpython_script_4.edges, Index=0, Wrap=True)  # -> Item, Item1
list_item_6 = ListItem(List=ghpython_script_4.nodes, Index=list_item_5.Item1, Wrap=True)
list_item_7 = ListItem(List=ghpython_script_4.nodes, Index=list_item_5.Item, Wrap=True)
line_2 = Line(StartPoint=list_item_7, EndPoint=list_item_6)  # -> flatten(Line)

# ----
point_4 = Point(ghpython_script_4.nodes)
list_item_8 = ListItem(List=point_4, Index=Slider(0, range=0..3), Wrap=True)
ghpython_script_19 = GhPythonScript(
    write=write_frame_json_file,
    indent="1",
    file_path=file_path,
    file_name=file_name_please_end_with_json,
    points=ghpython_script_4.nodes,
    connectivity=ghpython_script_4.edges,
    fixed_line_ids=ghpython_script_4.fixed_edges,
    crossec_area=pi,
    mt_config=ghpython_script_18.mt_config)  # -> out, a; inputs write: Boolean, indent: Int32, points: list of Point3d, connectivity: tree, fixed_line_ids: list of Int32, crossec_area: list
# ---------- ghpython_script_19: Python ----------
import Rhino.Geometry.Point3d as Point3d
import Grasshopper.DataTree as DataTree # Add, AddRange(list, GHPath(i, j))
import Grasshopper.Kernel.Data.GH_Path as GHPath
import System

import os
import json
import math
from collections import defaultdict
from ghpythonlib.treehelpers import list_to_tree, tree_to_list
#########################

write = True
if write:
    data = {}
    
    data['nodes'] = []
    for i, pt in enumerate(points):
        pt_data = {
        'is_grounded':False,
        'node_ind' : i,
        'point' : [pt.X, pt.Y, pt.Z]
        }
        data['nodes'].append(pt_data)
        
    
    e_con = tree_to_list(connectivity, lambda x:x)
    data['elements'] = []
    for i, e in enumerate(e_con):
        e_data = {
            'end_node_inds' : e,
            'cross_secs_ind' : i if len(crossec_area) == len(e_con) else 0,
        }
        data['elements'].append(e_data)
    
#    for gpt in grounded_pts:
#        for i, pt in enumerate(points):
#            if gpt.DistanceTo(pt) < 1e-8:
#                data['nodes'][i]['is_grounded'] = True
#                break
    data['fixed_element_ids'] = fixed_line_ids
    
    if len(crossec_area) == 1:
        data['cross_secs'] = [{
            'A' : crossec_area[0],
            'radius' : math.sqrt(crossec_area[0]/math.pi),
        }]
    else:
        assert len(crossec_area) == len(e_con)
        data['cross_secs'] = [{
            'A' : cs,
            'radius' : math.sqrt(cs/math.pi),
        } for cs in crossec_area]

    data["materials"] = [
        {
          "E": 1290000,
          "G12": 460714.2857142857,
          "density": 0.58
        }
    ]
    
    data['mt_config'] = mt_config
    
    with open(os.path.join(file_path, file_name), 'w') as f:
        json.dump(data, f, indent=indent)
# ---------- end ghpython_script_19 ----------
panel_9 = Panel(ghpython_script_4.edges)
panel_10 = Panel(ghpython_script_19.out)

# ---- group: fixed edges
list_item_9 = ListItem(List=pipe, Index=ghpython_script_4.fixed_edges, Wrap=True)

# ==== cluster BoundingBoxDimensions: Bounding Box Dimensions
content = ClusterInput()
bounding_box = BoundingBox(Content=content, Plane=PlaneXY(0, 0, 0), UnionBox=True)  # -> Box, Box_2
deconstruct_box = DeconstructBox(Box=bounding_box.Box)  # -> Plane, X, Y, Z
deconstruct_domain = DeconstructDomain(Domain=deconstruct_box.X)  # -> Start, End
deconstruct_domain_2 = DeconstructDomain(Domain=deconstruct_box.Z)  # -> Start, End
deconstruct_domain_3 = DeconstructDomain(Domain=deconstruct_box.Y)  # -> Start, End
subtraction = Subtraction(A=deconstruct_domain.End, B=deconstruct_domain.Start)
subtraction_2 = Subtraction(A=deconstruct_domain_2.End, B=deconstruct_domain_2.Start)
subtraction_3 = Subtraction(A=deconstruct_domain_3.End, B=deconstruct_domain_3.Start)
result = ClusterOutput(subtraction)
result_2 = ClusterOutput(subtraction_2)
result_3 = ClusterOutput(subtraction_3)
